# Grasshopper definition 1.3DScanImport&Scaling.gh (Grasshopper 1.0.7)
# plug-ins: Heteroptera, Human, Flexibility

# 3D Scan Import and Scaling
# 1.1 Create a new fork layer
# 
# 1.2 Input layer digit into the big panel
# 
# 1.3 Import High/Low Poly into corresponding sublayers
# 
# 1.4 Hide Low Poly and mark the Points
# 
# 1.5 Show Low Poly
# 
# 1.6 Group Low Poly + High Poly + 3 Points
# 
# 1.7 Scale the group according to the guide and orient it correctly
# 
# 
# 
# 
# 2.1 Duplicate the script.
# 
# 2.2 Increament the number in the panel for the new scan
# 
# 2.3 Repeat all the above with a new fork
# 
# 
# 
# 
# 3.1 You can start making assemblies
# 
# 
# 
# 
# NB:
# Save both file Rhino (7 not 8) and Grasshopper in
# https://drive.google.com/drive/u/0/folders/13nQTXaapD7pjCw7jiYSdxXGD1Lmxpe9S
# Format: Fork_##;##;##
panel = Panel("01")
concatenate = Concatenate(FragmentA="Skeleton(Auto)_", FragmentB=graft(panel))  # -> flatten(Result)
concatenate_2 = Concatenate(FragmentA="Points_", FragmentB=graft(panel))  # -> flatten(Result)
concatenate_3 = Concatenate(FragmentA=["HighPoly_", "LowPoly_"], FragmentB=graft(panel))  # -> flatten(Result)

# ---- group: Create New Fork Layer
create_new_fork_layer = GhPythonScript(Run=Button(), Reset=False, Color=ColourSwatch(SwatchColor=RGBA(0, 255, 255, 14)))  # inputs Run: Boolean, Reset: Boolean, Color: Color
# ---------- create_new_fork_layer: Python ----------
import scriptcontext as sc
import Rhino

# Switch to Rhino document
sc.doc = Rhino.RhinoDoc.ActiveDoc

if Reset:
    sc.sticky["ForkLayerCounter"] = 0
    a = "Counter reset to 0."

elif Run:
    # Initialize counter if not set
    if "ForkLayerCounter" not in sc.sticky:
        sc.sticky["ForkLayerCounter"] = 1
    else:
        sc.sticky["ForkLayerCounter"] += 1

    index = sc.sticky["ForkLayerCounter"]
    layer_number = str(index).zfill(2)

    # Define names
    main_layer_name = "Fork_" + layer_number
    sublayers = [
        "HighPoly_" + layer_number,
        "LowPoly_" + layer_number,
        "Points_" + layer_number,
        "Skeleton(Auto)_" + layer_number
    ]

    # Access Rhino layer table
    layers = sc.doc.Layers

    # Create main layer (no color change)
    if layers.FindByFullPath(main_layer_name, -1) == -1:
        parent_layer = Rhino.DocObjects.Layer()
        parent_layer.Name = main_layer_name
        layers.Add(parent_layer)

    parent_index = layers.FindByFullPath(main_layer_name, -1)

    # Create sublayers with selective color assignment
    for sub in sublayers:
        full_name = main_layer_name + "::" + sub
        if layers.FindByFullPath(full_name, -1) == -1:
            sub_layer = Rhino.DocObjects.Layer()
            sub_layer.Name = sub
            sub_layer.ParentLayerId = layers[parent_index].Id

            # Set color for HighPoly / LowPoly only
            if "HighPoly" in sub or "LowPoly" in sub:
                sub_layer.Color = Color  # Use the Grasshopper input color

            layers.Add(sub_layer)

    sc.doc.Views.Redraw()

    a = "Created Fork_{} hierarchy. High/LowPoly colored.".format(layer_number)

else:
    a = "Waiting for Run or Reset."

# Restore context to Grasshopper
sc.doc = ghdoc
# ---------- end create_new_fork_layer ----------

# ----
panel_2 = Panel(concatenate)
panel_3 = Panel(concatenate_3)
panel_4 = Panel(concatenate_2)
mesh = DynamicGeometryPipeline(
    LayerFilter=panel_3,
    TypeFilter=["Point", "Curve", "Mesh"],
    NameFilter="*",
    GroupByLayer=False,
    GroupByType=False,
    IncludeHidden=True,
    IncludeLocked=True,
    enableFullPath=False,
    listenToAttributes=True)  # -> flatten(GeometryOut)
points = DynamicGeometryPipeline(
    LayerFilter=panel_4,
    TypeFilter=["Point", "Curve", "Mesh"],
    NameFilter="*",
    GroupByLayer=False,
    GroupByType=False,
    IncludeHidden=True,
    IncludeLocked=True,
    enableFullPath=False,
    listenToAttributes=True)  # -> flatten(GeometryOut)
dynamic_geometry_pipeline = DynamicGeometryPipeline(
    LayerFilter=panel_2,
    TypeFilter=["Point", "Curve"],
    NameFilter=["0", "1", "2"],
    GroupByLayer=False,
    GroupByType=False,
    IncludeHidden=True,
    IncludeLocked=True,
    enableFullPath=False,
    listenToAttributes=True)  # -> flatten(GeometryOut)
list_item = ListItem(List=mesh, Index=1, Wrap=True)
skeleton = Skeleton(mesh=list_item, passing_switch=Button(), point=points)  # -> curve_2, plane_2

# ---- group: Skeleton
curve = Curve(skeleton.curve_2)
custom_preview_lineweights = CustomPreviewLineweights(
    Geometry=curve,
    Shader=[ColourSwatch(SwatchColor=RGB(132, 255, 0)), ColourSwatch(SwatchColor=RGB(72, 0, 255)), ColourSwatch(SwatchColor=RGB(255, 0, 0))],
    Thickness=10,
    Absolute=False)

# ---- group: Calibratiom Planes
show_uvw_surface = ShowUVWSurface(Surfaces=skeleton.plane_2, Size=1)
plane = Plane(skeleton.plane_2)
enumerator = Enumerator(Object=plane)  # -> Numbers, Color

# ----
point = Point(plane)
curve_2 = Curve(curve)
merge = Merge(Data1=point, Data2=curve_2)

# ---- group: Bake to Move Around
createattributes = CreateAttributes(Name=["0", "1", "2", "3", "4", "5"], LayerName=panel_2, GroupIndices=0, enableFullPath=False)
bake_geometry = BakeGeometry(Bake=Button(), Geometry=merge, Attributes=createattributes, DeleteOldBakes=False, PreserveTrees=False)

# ----
meshes = Group(Objects=mesh)
planes = Group(Objects=plane)
skeleton_2 = Group(Objects=curve)
list_item_2 = ListItem(List=plane, Index=0, Wrap=True)  # -> Item, Item1, Item2
list_item_3 = ListItem(List=dynamic_geometry_pipeline, Index=0, Wrap=True)  # -> Item, Item1, Item2
plane_3pt = Plane3Pt(PointA=list_item_2.Item, PointB=list_item_2.Item1, PointC=list_item_2.Item2)
plane_3pt_2 = Plane3Pt(PointA=list_item_3.Item, PointB=list_item_3.Item1, PointC=list_item_3.Item2)
merge_2 = Merge(Data1=meshes, Data2=planes, Data3=skeleton_2)  # -> flatten(Result)
orient = Orient(Geometry=merge_2, Source=plane_3pt, Target=plane_3pt_2)  # -> Geometry, Transform
list_item_4 = ListItem(List=orient.Geometry, Index=0, Wrap=True)  # -> Item, Item1, Item2
ungroup = Ungroup(Group=list_item_4.Item)
ungroup_2 = Ungroup(Group=list_item_4.Item1)
ungroup_3 = Ungroup(Group=list_item_4.Item2)
list_item_5 = ListItem(List=ungroup, Index=0, Wrap=True)

# ---- group: Rhino Object Preview
mesh_2 = Mesh(list_item_5)
plane_2 = Plane(ungroup_2)
curve_3 = Curve(ungroup_3)
enumerator_2 = Enumerator(Object=plane_2)  # -> Numbers, Color
custom_preview_lineweights_2 = CustomPreviewLineweights(
    Geometry=curve_3,
    Shader={diffuse=RGB(255, 105, 180), emission=RGB(76, 32, 54), shine=0.5, specular=RGB(255, 255, 255), transparency=0},
    Thickness=10,
    Absolute=False)

# ---- group: Preview Texture or Wireframe
merge_3 = Merge(Data1=list_item, Data2=mesh_2)
texture = BooleanToggle(False)
texture_or_wireframe = TextureOrWireframe(tree=merge_3, gate=texture)  # -> s_0_2, closed, s_0
panel_5 = Panel(texture_or_wireframe.closed)
custom_preview = CustomPreview(
    Geometry=texture_or_wireframe.s_0_2,
    Material={diffuse=RGB(222, 160, 222), emission=RGB(67, 48, 67), shine=0.5, specular=RGB(255, 255, 255), transparency=0.6705882353})
custom_preview_2 = CustomPreview(
    Geometry=texture_or_wireframe.s_0,
    Material={diffuse=RGB(242, 242, 242), emission=RGB(73, 73, 73), shine=0.5, specular=RGB(255, 255, 255), transparency=0})

# ==== cluster TextureOrWireframe
tree = ClusterInput()
flatten_tree = FlattenTree(Tree=tree, Path="{0}")  # -> graft(Tree)
deconstruct_mesh = DeconstructMesh(Mesh=flatten_tree)  # -> Vertices, Faces, Colours, Normals
gate = ClusterInput()
stream_filter = StreamFilter(Gate=gate, Stream1=deconstruct_mesh.Colours)
construct_mesh = ConstructMesh(Vertices=deconstruct_mesh.Vertices, Faces=deconstruct_mesh.Faces, Colours=stream_filter)
stream_filter_2 = StreamFilter(Gate=gate, Stream1=construct_mesh)

# ---- group: Mesh Preview & Control
mesh_edges = MeshEdges(Mesh=construct_mesh)  # -> NakedEdges, InteriorEdges, NonManifoldEdges
is_mesh_closed = IsMeshClosed(Mesh=construct_mesh)

# ----
s_0 = ClusterOutput(stream_filter_2)
closed = ClusterOutput(is_mesh_closed)
stream_filter_3 = StreamFilter(Gate=gate, Stream0=mesh_edges.InteriorEdges)
s_0_2 = ClusterOutput(stream_filter_3)

# ==== cluster Skeleton
mesh = ClusterInput()
mesh_2 = Mesh(mesh)
point = ClusterInput()
passing_switch = ClusterInput()
point_2 = Point(point)
stream_freeze_gate = StreamFreezeGate(Data=mesh_2, PassingSwitch=passing_switch)
meshskeleton = MeshSkeleton(Mesh=stream_freeze_gate)
end_points = EndPoints(Curve=meshskeleton)  # -> Start, End
multiple_curves = MultipleCurves(Curves=meshskeleton)  # -> Points, IndexA, IndexB, ParamA, ParamB
removeduplicatepts = RemoveDuplicatePts(Points=multiple_curves.Points, Tolerance=0.01)
closest_point = ClosestPoint(Point=end_points.Start, Cloud=removeduplicatepts)  # -> ClosestPoint, CPIndex, Distance
equality = Equality(FirstNumber=closest_point.Distance, SecondNumber=0)  # -> Equality, Inequality
sift_pattern = SiftPattern(List=flatten(meshskeleton), SiftPattern=equality.Inequality)  # -> Output0, Output1
flip_curve = FlipCurve(Curve=sift_pattern.Output1)  # -> Curve, Flag
combine_data = CombineData(Input0=sift_pattern.Output0, Input1=flip_curve.Curve)  # -> Result, Index
end_points_2 = EndPoints(Curve=combine_data.Result)  # -> Start, End
length = Length(Curve=combine_data.Result)
multiplication = Multiplication(A=length, B="0.3")
line = Line(StartPoint=end_points_2.Start, EndPoint=end_points_2.End)
average = Average(Input=multiplication)
merge = Merge(Data1=end_points_2.End, Data2=point_2)  # -> flatten(Result)
vector_display = VectorDisplay(Anchor=end_points_2.Start, Vector=line)
point_groups = PointGroups(Points=merge, Distance=average)  # -> Groups, Indices
list_item = ListItem(List=point_groups.Groups, Index=0, Wrap=True)  # -> Item, Item1
line_2 = Line(StartPoint=list_item.Item, EndPoint=list_item.Item1)  # -> flatten(Line)
merge_2 = Merge(Data1=combine_data.Result, Data2=line_2)  # -> flatten(Result)
end_points_3 = EndPoints(Curve=merge_2)  # -> Start, End
point_groups_2 = PointGroups(Points=end_points_3.End, Distance=average)  # -> Groups, Indices
list_item_2 = ListItem(List=merge_2, Index=point_groups_2.Indices, Wrap=True)
join_curves = JoinCurves(Curves=list_item_2, Preserve=False)
perp_frame = PerpFrame(Curve=reparameterize(join_curves), Parameter=1)  # -> flatten(Frame)
curve = Curve(reparameterize(flatten(join_curves)))
curve_2 = ClusterOutput(curve)
deconstruct_plane = DeconstructPlane(Plane=perp_frame)  # -> Origin, XAxis, YAxis, ZAxis
line_sdl = LineSDL(Start=deconstruct_plane.Origin, Direction=deconstruct_plane.YAxis, Length=50)
line_sdl_2 = LineSDL(Start=deconstruct_plane.Origin, Direction=deconstruct_plane.ZAxis, Length=50)
project = Project(Geometry=line_sdl, Plane=Plane(origin=(0, 0, 0), x=(0, 0, 1), y=(1, 0, 0)))  # -> Geometry, Transform
project_2 = Project(Geometry=line_sdl_2, Plane=PlaneXY(0, 0, 0))  # -> Geometry, Transform
angle = Angle(VectorA=Vector(0, 0, 1), VectorB=project.Geometry)  # -> Angle, Reflex
angle_2 = Angle(VectorA=Vector(0, 1, 0), VectorB=project_2.Geometry)  # -> Angle, Reflex
degrees = Degrees(Radians=angle.Angle)
degrees_2 = Degrees(Radians=angle_2.Angle)
expression = Expression(x=degrees_2, Expression="If(x>90, +90, 0)")
addition = Addition(A=degrees, B=expression)
rotate_plane = RotatePlane(Plane=perp_frame, Angle=expr("x-180", degrees(addition)))
plane = Plane(rotate_plane)
plane_2 = ClusterOutput(plane)
