# Grasshopper definition 2.AutomaticLapJointToolpathGenerator.gh (Grasshopper 1.0.7)
# plug-ins: Pufferfish, Heteroptera, Human

fork_09 = Geometry([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])
fork_02 = Geometry([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])
cluster = Cluster(rhinoobjects=fork_02)  # -> mesh, curve, plane_2
cluster_2 = Cluster(rhinoobjects=fork_09)  # -> mesh, curve, plane_2
mesh = Mesh(cluster.mesh)
curve = Curve(cluster.curve)
mesh_2 = Mesh(cluster_2.mesh)
curve_2 = Curve(cluster_2.curve)
plane = Plane(cluster.plane_2)
plane_2 = Plane(cluster_2.plane_2)

# ---- group: Fork_2
# Automatic Lap Joint Toolpath Generator
# Works with meshs, tree skeletons and planes from previous scripts.
# Only compute 2 meshes and 1 joint at a time.
reduce_mesh = ReduceMesh(Mesh=mesh, FaceCount=1000, Accuracy=1, FaceType=0, Distort=True, Normalize=False)  # -> Reduced, CountDifference
mesh_edges = MeshEdges(Mesh=reduce_mesh.Reduced)  # -> NakedEdges, InteriorEdges, NonManifoldEdges
custom_preview_lineweights = CustomPreviewLineweights(
    Geometry=mesh_edges.InteriorEdges,
    Shader={diffuse=RGB(255, 105, 180), emission=RGB(76, 32, 54), shine=0.5, specular=RGB(255, 255, 255), transparency=0},
    Absolute=False)

# ---- group: Fork_9
reduce_mesh_2 = ReduceMesh(Mesh=mesh_2, FaceCount=1000, Accuracy=1, FaceType=0, Distort=True, Normalize=False)  # -> Reduced, CountDifference
mesh_edges_2 = MeshEdges(Mesh=reduce_mesh_2.Reduced)  # -> NakedEdges, InteriorEdges, NonManifoldEdges
custom_preview_lineweights_2 = CustomPreviewLineweights(
    Geometry=mesh_edges_2.InteriorEdges,
    Shader={diffuse=RGB(255, 204, 0), emission=RGB(76, 61, 0), shine=0.5, specular=RGB(255, 255, 255), transparency=0},
    Absolute=False)

# ---- group: Plane Selection and Rotation
enumerator = Enumerator(Object=plane)  # -> Numbers, Color
list_item = ListItem(List=plane, Index=0, Wrap=True)
rotate_plane = RotatePlane(Plane=list_item, Angle=degrees(90))
deconstruct_plane = DeconstructPlane(Plane=rotate_plane)  # -> Origin, XAxis, YAxis, ZAxis
construct_plane = ConstructPlane(Origin=deconstruct_plane.Origin, XAxis=deconstruct_plane.XAxis, YAxis=deconstruct_plane.ZAxis)

list_item_2 = ListItem(List=plane_2, Index=1, Wrap=True)
enumerator_2 = Enumerator(Object=plane_2)  # -> Numbers, Color
rotate_plane_2 = RotatePlane(Plane=list_item_2, Angle=degrees(90))
deconstruct_plane_2 = DeconstructPlane(Plane=rotate_plane_2)  # -> Origin, XAxis, YAxis, ZAxis
construct_plane_2 = ConstructPlane(Origin=deconstruct_plane_2.Origin, XAxis=deconstruct_plane_2.XAxis, YAxis=deconstruct_plane_2.ZAxis)

# ---- group: Join Max Size
panel = Panel("-50 To 50")
panel_2 = Panel("-125 To 10")

# ----
joint_max_height = Slider(50, range=0..100)

# ---- group: Base Surface Split
plane_surface = PlaneSurface(Plane=construct_plane, XSize=panel, YSize=panel_2)
mesh_split = MeshSplit(Mesh=plane_surface, Splitters=mesh_2)
dispatch = Dispatch(List=mesh_split, DispatchPattern=[True, False])  # -> flatten(ListA), flatten(ListB)
mesh_edges_3 = MeshEdges(Mesh=dispatch.ListB)  # -> NakedEdges, InteriorEdges, NonManifoldEdges
join_curves = JoinCurves(Curves=mesh_edges_3.NakedEdges, Preserve=False)  # -> flatten(Curves)
boundary_surfaces = BoundarySurfaces(Edges=join_curves)

plane_surface_2 = PlaneSurface(Plane=construct_plane, XSize=panel, YSize=panel_2)
mesh_split_2 = MeshSplit(Mesh=plane_surface_2, Splitters=mesh)
dispatch_2 = Dispatch(List=mesh_split_2, DispatchPattern=[True, False])  # -> flatten(ListA), flatten(ListB)
mesh_edges_4 = MeshEdges(Mesh=dispatch_2.ListB)  # -> NakedEdges, InteriorEdges, NonManifoldEdges
join_curves_2 = JoinCurves(Curves=mesh_edges_4.NakedEdges, Preserve=False)  # -> flatten(Curves)
boundary_surfaces_2 = BoundarySurfaces(Edges=join_curves_2)

# ---- group: Cut Depth
cut_depth = Slider(20, range=0..50)
range = Range(Domain=Domain(0, 1), Steps=cut_depth)  # -> graft(Range)
division = Division(A=joint_max_height, B=cut_depth)
amplitude = Amplitude(Vector=construct_plane, Amplitude=division)  # -> expr("-x", Vector)
cut_depth_2 = Panel(division)

# ----
amplitude_2 = Amplitude(Vector=construct_plane, Amplitude=expr("-x", joint_max_height))
amplitude_3 = Amplitude(Vector=construct_plane_2, Amplitude=expr("-x", joint_max_height))
move = Move(Geometry=boundary_surfaces, Motion=amplitude_3)  # -> Geometry, Transform
move_2 = Move(Geometry=boundary_surfaces_2, Motion=amplitude_2)  # -> Geometry, Transform

# ---- group: Tween Surfaces and Trim With Mesh
tween_two_surfaces = TweenTwoSurfaces(SurfaceA=boundary_surfaces, SurfaceB=move.Geometry, Factor=flatten(range), Refit=0, PointSample=0)
copy_trim = CopyTrim(Source=move.Geometry, Target=tween_two_surfaces)
mesh_split_3 = MeshSplit(Mesh=copy_trim, Splitters=mesh)
mesh_edges_5 = MeshEdges(Mesh=mesh_split_3)  # -> NakedEdges, InteriorEdges, NonManifoldEdges
join_curves_3 = JoinCurves(Curves=mesh_edges_5.NakedEdges, Preserve=False)  # -> flatten(Curves)
center = Center(Geometry=join_curves_3)  # -> Center, Dimension
scale = Scale(Geometry=join_curves_3, Center=center.Center, Factor=0.9)  # -> Geometry, Transform
divide_curve = DivideCurve(Curve=scale.Geometry, Count=10, Kinks=False)  # -> Points, Tangents, Parameters
mesh_inclusion = MeshInclusion(Mesh=mesh, Point=divide_curve.Points, Strict=False)
mass_addition = MassAddition(Input=mesh_inclusion)  # -> flatten(Result), PartialResults
equality = Equality(FirstNumber=mass_addition.Result, SecondNumber=10)  # -> Equality, Inequality
cull_pattern = CullPattern(List=join_curves_3, CullPattern=equality.Equality)
boundary_surfaces_3 = BoundarySurfaces(Edges=cull_pattern)
center_2 = Center(Geometry=boundary_surfaces_3)  # -> Center, Dimension
scale_2 = Scale(Geometry=boundary_surfaces_3, Center=center_2.Center, Factor=1.1)  # -> Geometry, Transform

tween_two_surfaces_2 = TweenTwoSurfaces(SurfaceA=boundary_surfaces_2, SurfaceB=move_2.Geometry, Factor=flatten(range), Refit=0, PointSample=0)
copy_trim_2 = CopyTrim(Source=move_2.Geometry, Target=tween_two_surfaces_2)
mesh_split_4 = MeshSplit(Mesh=copy_trim_2, Splitters=mesh_2)
mesh_edges_6 = MeshEdges(Mesh=mesh_split_4)  # -> NakedEdges, InteriorEdges, NonManifoldEdges
join_curves_4 = JoinCurves(Curves=mesh_edges_6.NakedEdges, Preserve=False)  # -> flatten(Curves)
center_3 = Center(Geometry=join_curves_4)  # -> Center, Dimension
scale_3 = Scale(Geometry=join_curves_4, Center=center_3.Center, Factor=0.9)  # -> Geometry, Transform
divide_curve_2 = DivideCurve(Curve=scale_3.Geometry, Count=10, Kinks=False)  # -> Points, Tangents, Parameters
mesh_inclusion_2 = MeshInclusion(Mesh=mesh_2, Point=divide_curve_2.Points, Strict=False)
mass_addition_2 = MassAddition(Input=mesh_inclusion_2)  # -> flatten(Result), PartialResults
equality_2 = Equality(FirstNumber=mass_addition_2.Result, SecondNumber=10)  # -> Equality, Inequality
cull_pattern_2 = CullPattern(List=join_curves_4, CullPattern=equality_2.Equality)
boundary_surfaces_4 = BoundarySurfaces(Edges=cull_pattern_2)
center_4 = Center(Geometry=boundary_surfaces_4)  # -> Center, Dimension
scale_4 = Scale(Geometry=boundary_surfaces_4, Center=center_4.Center, Factor=1.1)  # -> Geometry, Transform

# ---- group: Stepover
overlap = Slider(5, range=0..10)

# ---- group: Final Contouring and Sorting
contour = Contour(Shape=scale_2.Geometry, Point=Point(0, 0, 0), Direction=rotate_plane, Distance=overlap)
dispatch_3 = Dispatch(List=flatten(contour), DispatchPattern=[True, False])  # -> ListA, ListB
flip_curve = FlipCurve(Curve=dispatch_3.ListB)  # -> Curve, Flag
weave = Weave(Pattern=[0, 1], Stream0=dispatch_3.ListA, Stream1=flip_curve.Curve, NullGaps=False)
unflatten_tree = UnflattenTree(Tree=weave, Guide=contour)
divide_curve_3 = DivideCurve(Curve=unflatten_tree, Count=1, Kinks=False)  # -> simplify(Points), Tangents, Parameters
trim_tree = TrimTree(Tree=divide_curve_3.Points, Depth=2)
list_item_3 = ListItem(List=trim_tree, Index=-1, Wrap=True)  # -> flatten(Item)
cull_index = CullIndex(List=list_item_3, Indices=0, Wrap=True)
move_3 = Move(Geometry=cull_index, Motion=amplitude)  # -> Geometry, Transform
insert_items = InsertItems(List=reverse(trim_tree), Item=graft(move_3.Geometry), Indices=-1, Wrap=True)
cull_index_2 = CullIndex(List=flatten(insert_items), Indices=-1, Wrap=True)  # -> flatten(List)
polyline = PolyLine(Vertices=cull_index_2, Closed=False)

contour_2 = Contour(Shape=scale_4.Geometry, Point=Point(0, 0, 0), Direction=rotate_plane_2, Distance=overlap)
dispatch_4 = Dispatch(List=flatten(contour_2), DispatchPattern=[True, False])  # -> ListA, ListB
flip_curve_2 = FlipCurve(Curve=dispatch_4.ListB)  # -> Curve, Flag
weave_2 = Weave(Pattern=[0, 1], Stream0=dispatch_4.ListA, Stream1=flip_curve_2.Curve, NullGaps=False)
unflatten_tree_2 = UnflattenTree(Tree=weave_2, Guide=contour_2)
divide_curve_4 = DivideCurve(Curve=unflatten_tree_2, Count=1, Kinks=False)  # -> simplify(Points), Tangents, Parameters
trim_tree_2 = TrimTree(Tree=divide_curve_4.Points, Depth=2)
list_item_4 = ListItem(List=trim_tree_2, Index=-1, Wrap=True)  # -> flatten(Item)
cull_index_3 = CullIndex(List=list_item_4, Indices=0, Wrap=True)
move_4 = Move(Geometry=cull_index_3, Motion=amplitude)  # -> Geometry, Transform
insert_items_2 = InsertItems(List=reverse(trim_tree_2), Item=graft(move_4.Geometry), Indices=-1, Wrap=True)
cull_index_4 = CullIndex(List=flatten(insert_items_2), Indices=-1, Wrap=True)  # -> flatten(List)
polyline_2 = PolyLine(Vertices=cull_index_4, Closed=False)

# ----
custom_preview_lineweights_3 = CustomPreviewLineweights(
    Geometry=polyline,
    Shader={diffuse=RGB(255, 105, 180), emission=RGB(76, 32, 54), shine=0.5, specular=RGB(255, 255, 255), transparency=0},
    Thickness=2,
    Absolute=False)
custom_preview_lineweights_4 = CustomPreviewLineweights(
    Geometry=polyline_2,
    Shader={diffuse=RGB(255, 204, 0), emission=RGB(76, 61, 0), shine=0.5, specular=RGB(255, 255, 255), transparency=0},
    Thickness=2,
    Absolute=False)
createattributes = CreateAttributes(LayerName="Fork2_Joint1", GroupIndices=12, enableFullPath=False)
move_to_point = MoveToPoint(Geometry=construct_plane, PointA=construct_plane, PointB=cull_index_2)  # -> Moved, Vector, Transform
point = Point(plane)
merge = Merge(Data1=point, Data2=move_to_point.Moved)
bake_geometry = BakeGeometry(Bake=Button(), Geometry=merge, Attributes=createattributes, DeleteOldBakes=False, PreserveTrees=False)

# ==== cluster Cluster
rhinoobjects = ClusterInput()
sort_objects_by_type = SortObjectsByType(RhinoObjects=rhinoobjects)  # -> Points, Curves, Surfaces, Breps, Meshes, TextObjects, HatchObjects, LightObjects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
center = Center(Geometry=sort_objects_by_type.Breps)  # -> Center, Dimension
plane = Plane(sort_objects_by_type.Breps)
move_to_point = MoveToPoint(Geometry=plane, PointA=plane, PointB=center.Center)  # -> Moved, Vector, Transform
curve = ClusterOutput(sort_objects_by_type.Curves)
mesh = ClusterOutput(sort_objects_by_type.Meshes)
plane_2 = ClusterOutput(move_to_point.Moved)
