# Grasshopper definition 3.RoboticMilling.gh (Grasshopper 1.0.7)
# plug-ins: KUKA|prc - parametric robot control, Pufferfish, Flexibility, Human, Heteroptera

fork_2_milling_1 = Geometry([Point(365.6603535, -497.0352425, 374.0184977), Point(251.058459, 438.9940682, 410.9932813), Point(557.4429626, 365.2498627, 399), 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])
fork_2_milling_2 = Geometry([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, Point(365.660445, -497.0352397, 374.018495), Point(251.058459, 438.9940682, 410.9932813), Point(557.4429626, 365.2498627, 399)])
fork_2_milling_222 = Geometry([Point(557.4429626, 365.2498627, 399), Point(251.058459, 438.9940682, 410.9932813), Point(365.660445, -497.0352397, 374.018495), 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])
fork_8_joint_2 = Geometry([Point(575.5370761, -399.8001315, 405.9105854), Point(540.5123659, 394.822937, 379.9999847), Point(273.9711774, 346.5269268, 367.0149111), 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])
fork_8_joint_3 = Geometry([Point(575.5370761, -399.8001315, 405.9105854), Point(540.5123659, 394.822937, 379.9999847), Point(273.9711774, 346.5269268, 367.0149111), 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])
fork_8_joint_4 = Geometry([Point(575.5370761, -399.8001315, 405.9105854), Point(540.5123659, 394.822937, 379.9999847), Point(273.9711774, 346.5269268, 367.0149111), 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])
fork_7_joint_1 = Geometry([Point(347.420537, -366.6047104, 391.1913568), Point(340.4983439, 367.5190406, 384.1304582), Point(578.564209, 345.093219, 372), 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])
fork_7_joint_2 = Geometry([Point(349.9808402, -366.8458911, 391.0608986), Point(343.0586471, 367.2778599, 384), Point(581.1245122, 344.8520382, 371.8695418), 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])
fork_7_joint_3 = Geometry([Point(414.5660331, -379.5956367, 387.955725), Point(537.3568005, 343.4931114, 354.7812691), Point(299.1821062, 359.8444611, 372.9710994), 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])
fork_2 = Geometry([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])
fork_8 = Geometry([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])
fork_7 = Geometry([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, Point(350.1999565, -358.0466733, 390.9605864), Point(343.3610935, 367.2493694, 383.9845891), Point(578.564209, 345.093219, 372)])
fork_7flipped = Geometry([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])
move = Move(Geometry=fork_7_joint_3, Motion=Vector(50, 0, 0))  # -> Geometry, Transform
import_toolpath_planes = ImportToolpathPlanes(rhinoobjects=move.Geometry)
move_2 = Move(Geometry=fork_7flipped, Motion=Vector(50, 0, 0))  # -> Geometry, Transform
enumerator = Enumerator(Object=import_toolpath_planes)  # -> Numbers, Color
cluster = Cluster(rhinoobjects=move_2.Geometry)  # -> mesh, curve, plane_2

# ---- group: Mesh Preview
# Robotic Milling
# Set the job (Calibration, Touchpoint, Milling). Change "Sequence" for each joint of each fork.
reduce_mesh = ReduceMesh(Mesh=cluster.mesh, FaceCount=1000, Accuracy=1, FaceType=0, Distort=True, Normalize=False)  # -> Reduced, CountDifference
mesh_edges = MeshEdges(Mesh=reduce_mesh.Reduced)  # -> NakedEdges, InteriorEdges, NonManifoldEdges
custom_preview_lineweights = CustomPreviewLineweights(
    Geometry=mesh_edges.InteriorEdges,
    Shader={diffuse=RGB(255, 105, 180), emission=RGB(76, 32, 54), shine=0.5, specular=RGB(255, 255, 255), transparency=0},
    Absolute=False)

# ----
flip_plane = FlipPlane(Plane=import_toolpath_planes, ReverseX=False, ReverseY=False, SwapAxes=True)
rotate_plane = RotatePlane(Plane=flip_plane, Angle=degrees(-90))
polyline = PolyLine(Vertices=import_toolpath_planes, Closed=False)

# ---- group: Time (Min)
length = Length(Curve=polyline)
ghpython_script = GhPythonScript(Speed=Slider(0.012, range=0..0.1), Length=length)  # -> out, TimeMin
# ---------- ghpython_script: Python ----------
# Check for valid input
if Speed is not None and Length is not None and Speed > 0:
    # Convert mm to meters
    length_m = Length / 1000.0
    # Time in seconds
    time_sec = length_m / Speed
    # Convert to minutes
    TimeMin = time_sec / 60.0
else:
    TimeMin = None
# ---------- end ghpython_script ----------
time_min = Panel(ghpython_script.TimeMin)

# ----
custom_preview_lineweights_2 = CustomPreviewLineweights(
    Geometry=polyline,
    Shader={diffuse=RGB(255, 105, 180), emission=RGB(76, 32, 54), shine=0.5, specular=RGB(255, 255, 255), transparency=0},
    Thickness=2,
    Absolute=False)
mesh = Mesh(cluster.mesh)
curve = Curve(cluster.curve)
plane = Plane(cluster.plane_2)
list_item = ListItem(Index=0, Wrap=True)

# ---- group: Rotate to Fix Tool Orientation
rotate_plane_2 = RotatePlane(Plane=plane, Angle=degrees(0))
show_uvw_surface = ShowUVWSurface(Surfaces=rotate_plane_2, Size=1)
point = Point(rotate_plane_2)

# ---- group: Touchpoint Sequence
list_item_2 = ListItem(List=rotate_plane, Index=0, Wrap=True)
move_3 = Move(Geometry=list_item_2, Motion=Vector(0, 0, 30))  # -> Geometry, Transform
ptp_movement_kuka_prc = PTPMovementKUKAPrc(TargetAsPlane=move_3.Geometry, Speed=3, extaxenabled=False)
ptp_movement_kuka_prc_2 = PTPMovementKUKAPrc(TargetAsPlane=list_item_2, Speed=1, extaxenabled=False)
merge = Merge(Data1=ptp_movement_kuka_prc, Data2=ptp_movement_kuka_prc_2, Data3=ptp_movement_kuka_prc)

# ---- group: Milling Sequence
list_item_3 = ListItem(List=rotate_plane, Index=0, Wrap=True)
linear_movement_kuka_prc = LINearMovementKUKAPrc(TargetAsPlane=rotate_plane, Speed=0.012, extaxenabled=False)
move_4 = Move(Geometry=list_item_3, Motion=Vector(0, 0, 30))  # -> Geometry, Transform
ptp_movement_kuka_prc_3 = PTPMovementKUKAPrc(TargetAsPlane=move_4.Geometry, Speed=2, extaxenabled=False)
merge_2 = Merge(Data1=ptp_movement_kuka_prc_3, Data2=linear_movement_kuka_prc, Data3=ptp_movement_kuka_prc_3)

# ----
approach_speed = Slider(2, range=0..10)

# ---- group: Calibration Target Sequence
offset_plane = OffsetPlane(Plane=rotate_plane_2, Distance=40, BothSides=0, OffsetX=False, OffsetY=False, OffsetZ=True)  # -> flatten(Offset)
jog_speed = Slider(10, range=0..10)
move_5 = Move(Geometry=offset_plane, Motion=Vector(0, 0, 200))  # -> Geometry, Transform
ptp_movement_kuka_prc_4 = PTPMovementKUKAPrc(TargetAsPlane=move_5.Geometry, Speed=jog_speed, extaxenabled=False, interpolation="C_PTP")
ptp_movement_kuka_prc_5 = PTPMovementKUKAPrc(TargetAsPlane=offset_plane, Speed=jog_speed, extaxenabled=False, interpolation="C_PTP")
ptp_movement_kuka_prc_6 = PTPMovementKUKAPrc(TargetAsPlane=rotate_plane_2, Speed=approach_speed, extaxenabled=False)
ptp_movement_kuka_prc_7 = PTPMovementKUKAPrc(TargetAsPlane=offset_plane, Speed=jog_speed, extaxenabled=False, interpolation="C_PTP")
weave = Weave(
    Pattern=[0, 1, 2, 3, 4],
    Stream0=ptp_movement_kuka_prc_4,
    Stream1=ptp_movement_kuka_prc_5,
    Stream2=ptp_movement_kuka_prc_6,
    Stream3=ptp_movement_kuka_prc_7,
    Stream4=ptp_movement_kuka_prc_4,
    NullGaps=False)

# ---- group: Dashboard / Program Name & Save
job = ValueList({"Calibration", "Touchpoint", "Milling", "Calibration_Flipped_"}, selected="Milling")
fork_number = ValueList({"01", "02", "03", "04", "05", "06", "07", "08", "09", "10", "11", "12", "13", "14", "15"}, selected="07")
joint = ValueList({"01", "02", "03", "04", "05", "222", "33"}, selected="33")
program_name = ProgramName(relay=job, fragment_b_2=fork_number, fragment_b=joint)  # -> result, result_2
save = Button()

# ---- group: Dashboard / Setup
mesh_2 = Mesh(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)
panel = Panel("""x = 148.3
y = 2.42
Z = 56.52""")
custom_tool_kuka_prc = CustomToolKUKAPrc(
    CustomToolGeometry=mesh_2,
    isExternal=False,
    toolid=5,
    toolvala=0,
    toolvalb=0,
    toolvalc=0,
    toolvalx=146,
    toolvaly=0,
    toolvalz=56.52,
    valuesset=True)
agilus_kr6_10_r900_2_robot = AgilusKR610R9002Robot(infiniterot=False)
table = Brep(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)
custom_preview = CustomPreview(
    Geometry=table,
    Material={diffuse=RGB(222, 222, 222), emission=RGB(67, 67, 67), shine=0.5, specular=RGB(255, 255, 255), transparency=0})

# ----
simulation = Slider(0.2998, range=0..1)
stream_filter = StreamFilter(Gate=program_name.result_2, Stream0=weave, Stream1=merge, Stream2=merge_2)  # -> flatten(Stream)

# ---- group: Dashboard
robot_program = Panel(stream_filter)

# ----
kuka_prc_core = KUKAPrcCORE(
    SimulationSlider=simulation,
    KUKAPrcCommands=stream_filter,
    Tool=custom_tool_kuka_prc,
    Robot=agilus_kr6_10_r900_2_robot,
    SaveToggle=save,
    Filename=program_name.result,
    PRC_BaseExpose=False,
    PRC_SaveNameExpose=True,
    PRCsettings="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")  # -> RobotGeometry, AnalysisOutput

# ==== cluster ProgramName
panel = Panel("""Touchpoint
Milling""")
relay = ClusterInput()
expression = Expression(x=relay, Expression="If(x=\"Calibration\", 0, If(x=\"Touchpoint\", 1, If(x=\"Milling\", 2, \"\")))")
match_text = MatchText(Text=relay, Pattern=panel, Case=True)
fragment_b = ClusterInput()
sort_list = SortList(Keys=match_text)  # -> reverse(Keys), ValuesValuesA
concatenate = Concatenate(FragmentA="_", FragmentB=fragment_b)
list_item = ListItem(List=sort_list.Keys, Index=0, Wrap=True)
stream_filter = StreamFilter(Gate=list_item, Stream1=concatenate)
fragment_b_2 = ClusterInput()
concatenate_2 = Concatenate(Fragment_A=relay, A="_", Fragment_B=fragment_b_2, B=stream_filter)
result = ClusterOutput(concatenate_2)
result_2 = ClusterOutput(expression)

# ==== cluster Cluster
rhinoobjects = ClusterInput()
sort_objects_by_type = SortObjectsByType(RhinoObjects=rhinoobjects)  # -> Points, Curves, Surfaces, Breps, Meshes, TextObjects, HatchObjects, LightObjects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
center = Center(Geometry=sort_objects_by_type.Breps)  # -> Center, Dimension
plane = Plane(sort_objects_by_type.Breps)
move_to_point = MoveToPoint(Geometry=plane, PointA=plane, PointB=center.Center)  # -> Moved, Vector, Transform
curve = ClusterOutput(sort_objects_by_type.Curves)
mesh = ClusterOutput(sort_objects_by_type.Meshes)
plane_2 = ClusterOutput(move_to_point.Moved)

# ==== cluster ImportToolpathPlanes
rhinoobjects = ClusterInput()
sort_objects_by_type = SortObjectsByType(RhinoObjects=rhinoobjects)  # -> Points, Curves, Surfaces, Breps, Meshes, TextObjects, HatchObjects, LightObjects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
center = Center(Geometry=sort_objects_by_type.Breps)  # -> Center, Dimension
plane = Plane(sort_objects_by_type.Breps)
move_to_point = MoveToPoint(Geometry=plane, PointA=plane, PointB=center.Center)  # -> Moved, Vector, Transform
moved = ClusterOutput(move_to_point.Moved)
