# Grasshopper definition TestTreeSlicing.gh (Grasshopper 1.0.7)
# plug-ins: Pufferfish, Weaverbird, MeshEdit Components, Heteroptera, Human, Flexibility, CockroachGH, Kangaroo2 Components

subd = SubD(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)
mesh_from_subd = MeshFromSubD(SubD=subd, Density=2)
geometry = Geometry([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])
deconstruct_mesh = DeconstructMesh(Mesh=mesh_from_subd)  # -> Vertices, Faces, Colours, Normals
list_length = ListLength(List=deconstruct_mesh.Vertices)
random = Random(Range=Domain(0, 1), Number=list_length, Seed=1)
random_2 = Random(Range=Domain(0, 1), Number=list_length, Seed=2)
random_3 = Random(Range=Domain(0, 1), Number=list_length, Seed=3)
vector_xyz = VectorXYZ(XComponent=random, YComponent=random_2, ZComponent=random_3)  # -> Vector, Length
move = Move(Geometry=deconstruct_mesh.Vertices, Motion=vector_xyz.Vector)  # -> Geometry, Transform
construct_mesh = ConstructMesh(Vertices=move.Geometry, Faces=deconstruct_mesh.Faces)
align_vertices = AlignVertices(Mesh=construct_mesh, Tolerance=2)  # -> Result, Count
weaverbird_s_catmull_clark_subdivision = WeaverbirdsCatmullClarkSubdivision(MeshCurves=align_vertices.Result, Level=1, SmoothNakedEdges=1)
is_mesh_closed = IsMeshClosed(Mesh=weaverbird_s_catmull_clark_subdivision)
mesh_edges = MeshEdges(Mesh=weaverbird_s_catmull_clark_subdivision)  # -> NakedEdges, InteriorEdges, NonManifoldEdges
face_normal_direction = FaceNormalDirection(M=weaverbird_s_catmull_clark_subdivision)  # -> out, G, A, P; inputs V: Vector3d; disabled
# ---------- face_normal_direction: VB ----------
    Component.Params.Input(0).Name = "Mesh"
    Component.Params.Input(0).Description = "Open or closed mesh"
    Component.Params.Input(1).Name = "Vector (Optional)"
    Component.Params.Input(1).Description = "Vector which defines the up direction to be tested against"
    Component.Params.Input(2).Name = "Angle Domain"
    Component.Params.Input(2).Description = "The domain that describes the range of angles to be tested against"
    Component.Params.Input(3).Name = "Absolute "
    Component.Params.Input(3).Description = "If true the returned angles are made absolute"

    Component.Params.Output(1).Name = "Preview Mesh"
    Component.Params.Output(1).Description = "A greyscale preview mesh reflecting the range of values"
    Component.Params.Output(2).Name = "Angle"
    Component.Params.Output(2).Description = "The face normal angle relative to the input vector"
    Component.Params.Output(3).Name = "Pattern"
    Component.Params.Output(3).Description = "If the R input is used, the status of each sample point relative to the provided range (0 = Below, 1 = Within, 2 = Above)"

    If M IsNot Nothing Then
      If v = Nothing Then v = New vector3d(0, 0, 1)
      Dim i,j,k,s As Integer

      Dim mf As Rhino.Geometry.Collections.MeshFaceList = Nothing
      Dim mfn As Rhino.Geometry.Collections.MeshFaceNormalList = Nothing
      Dim mv As Rhino.Geometry.Collections.MeshVertexList = Nothing
      Dim mtv As Rhino.Geometry.Collections.MeshTopologyVertexList = Nothing
      Dim mte As Rhino.Geometry.Collections.MeshTopologyEdgeList = Nothing
      Dim mn As Rhino.Geometry.Collections.MeshVertexNormalList = Nothing
      Dim mc As Rhino.Geometry.Collections.MeshVertexColorList = Nothing

      If M.facenormals.count() = 0 Then M.FaceNormals.ComputeFaceNormals()

      mf = m.Faces
      mfn = m.facenormals
      mv = m.Vertices
      mtv = m.TopologyVertices
      mte = m.TopologyEdges
      mn = m.Normals
      mc = m.VertexColors

      Dim arrAng As New list(Of Double)
      Dim mvo As New list(Of Point3d)
      Dim mfo As New list(Of meshface)
      Dim oc As New list(Of color)
      Dim tv As Integer
      Dim aMin, aMax As Double
      Dim arrPat As New list(Of Integer)

      For i = 0 To mfn.count() - 1 Step 1
        Dim ang As New Double
        s = mvo.count()
        ang = vector3d.VectorAngle(V, mfn.item(i))

        If X Then If ang > (math.PI / 2) Then ang = math.Abs(math.PI - ang)

        If i = 0 Then aMin = ang Else If ang < aMin Then aMin = ang
        If ang > aMax Then aMax = ang

        If mf.item(i).isquad() Then
          mvo.add(mv.item(mf.item(i).A))
          mvo.add(mv.item(mf.item(i).B))
          mvo.add(mv.item(mf.item(i).C))
          mvo.add(mv.item(mf.item(i).D))
          mfo.add(New meshface(s, s + 1, s + 2, s + 3))
        Else
          mvo.add(mv.item(mf.item(i).A))
          mvo.add(mv.item(mf.item(i).B))
          mvo.add(mv.item(mf.item(i).C))
          mfo.add(New meshface(s, s + 1, s + 2))
        End If

        arrAng.add(ang)
      Next

      If R = Nothing Then
        R.t0 = amin
        R.t1 = amax
      End If

      For i = 0 To mfn.count() - 1 Step 1
        If mf.item(i).isquad() Then k = 3 Else k = 2

        If arrAng.item(i) < R.T0 Then
          For j = 0 To k Step 1
            oc.add(color.FromArgb(0, 0, 255))
          Next
          arrPat.add(0)
        ElseIf ((arrAng.item(i) > R.T1) Or ((R.t0 = 0) And (R.t1 = 0))) Then
          For j = 0 To k Step 1
            oc.add(color.FromArgb(255, 0, 0))
          Next
          arrPat.add(2)
        Else
          For j = 0 To k Step 1
            tv = math.Floor((arrAng.item(i) - R.T0) / (R.t1 - R.t0) * 255)
            oc.add(color.FromArgb(tv, tv, tv))
          Next
          arrPat.add(1)
        End If
      Next
      Dim mo As New mesh
      mo.vertices.AddVertices(mvo.toarray())
      mo.Faces.AddFaces(mfo.toarray())
      mo.VertexColors.AppendColors(oc.toarray())

      G = mo
      A = arrAng
      P = arrPat

    End If
# ---------- end face_normal_direction ----------
custom_preview = CustomPreview(
    Geometry=weaverbird_s_catmull_clark_subdivision,
    Material={diffuse=RGB(221, 160, 221), emission=RGB(66, 48, 66), shine=0.5, specular=RGB(255, 255, 255), transparency=0})  # disabled
select_mesh_faces = SelectMeshFaces()  # -> out, I, P, F, N; inputs M: Mesh
# ---------- select_mesh_faces: VB usings ----------
Imports System.IO
Imports System.Linq
Imports System.Data
Imports System.Drawing
Imports System.Reflection
Imports System.Windows.Forms
Imports System.Xml
Imports System.Xml.Linq
Imports Microsoft.VisualBasic
Imports System.Runtime.InteropServices

Imports Rhino.DocObjects
Imports Rhino.Collections
Imports GH_IO
Imports GH_IO.Serialization
# ---------- select_mesh_faces: VB ----------
    component.Params.Input(0).name = "Mesh"
    component.Params.Input(0).Description = "A mesh referenced from Rhino or Grasshopper mesh which will be temporarily baked for selection"
    component.Params.Input(1).name = "Update"
    component.Params.Input(1).Description = "If true, a Rhino prompt should appear requesting the selection of representative geometry." & vbCrlf & "NOTE: Do Not Use Button, all other boolean components work, Button will require running twice"

    component.Params.Output(1).name = "Indices"
    component.Params.Output(1).Description = "The indices of the selected faces"
    component.Params.Output(2).name = "Point"
    component.Params.Output(2).Description = "A Point at the selected index"
    component.Params.Output(3).name = "Face"
    component.Params.Output(3).Description = "A Face at the selected index"
    component.Params.Output(4).name = "Face Normal"
    component.Params.Output(4).Description = "A Face Normal at the selected index"

    Dim rd As RhinoDoc = Rhino.RhinoDoc.ActiveDoc

    Grasshopper.Instances.ActiveCanvas.Enabled = True
    Dim mf As Rhino.Geometry.Collections.MeshFaceList
    Dim mfn As Rhino.Geometry.Collections.MeshFaceNormalList
    Dim oRf() As ObjRef = Nothing
    Dim j,k As Integer
    Dim tID As GUID
    Dim oa As New ObjectAttributes

    If A Then
      If M IsNot Nothing Then

        If m.FaceNormals.Count() = 0 Then m.FaceNormals.ComputeFaceNormals()

        ID.clear()
        PO.clear()
        FC.clear()
        NR.clear()
        mf = m.Faces
        mfn = m.FaceNormals

        oa.ColorSource = ObjectColorSource.ColorFromObject
        oa.ObjectColor = color.FromArgb(255, 0, 255)
        tID = rd.Objects.AddMesh(m, oa)
        rd.Views.Redraw()
        Call Rhino.Input.RhinoGet.GetMultipleObjects("Select Mesh Faces", True, Rhino.DocObjects.ObjectType.MeshFace, oRf)
        rd.Objects.Delete(tID, True)

        k = 0
        If oRf IsNot Nothing Then
          For j = 0 To (oRf.Length - 1) Step 1

            If oRf(j).ObjectId() = tID Then
              ID.add(oRf(j).GeometryComponentIndex.Index)
              PO.add(mf.GetFaceCenter(ID.item(k)))
              FC.add(mf(ID.item(k)))
              NR.add(mfn(ID.item(k)))
              k += 1
            End If
          Next
        End If
      End If

      rd.Views.Redraw()
    Else
      If M IsNot Nothing Then
        mf = m.Faces
        mfn = m.FaceNormals
        PO.clear()
        FC.clear()
        NR.clear()

        For j = 0 To (ID.toarray().Length - 1) Step 1
          PO.add(mf.GetFaceCenter(ID.item(j)))
          FC.add(mf(ID.item(j)))
          NR.add(mfn(ID.item(j)))
        Next
      End If
    End If

    I = ID
    P = PO
    F = FC
    N = NR
# ---------- select_mesh_faces: VB additional code ----------
  Dim ID As New list(Of Integer)
  Dim po As New list(Of point3d)
  Dim fc As New list(Of meshface)
  Dim nr As New list(Of vector3d)
# ---------- end select_mesh_faces ----------
face_normals = FaceNormals(Mesh=weaverbird_s_catmull_clark_subdivision)  # -> Centers, Normals
mesh_explode = MeshExplode(Mesh=weaverbird_s_catmull_clark_subdivision, Interpolate=False)
face_to_face_angles = FaceToFaceAngles(M=weaverbird_s_catmull_clark_subdivision, O=0, R=Domain(0, 0.2))  # -> out, G, A, V, T, P; inputs M: Mesh
# ---------- face_to_face_angles: VB ----------
    Component.Params.Input(0).Name = "Mesh"
    Component.Params.Input(0).Description = "Open or closed mesh"
    Component.Params.Input(1).Name = "Mode"
    Component.Params.Input(1).Description = "Designates which angle to check against (0 = Average, 1 = Min, 2 = Max)"
    Component.Params.Input(2).Name = "Angle Domain"
    Component.Params.Input(2).Description = "The domain that describes the range of angles to be tested against"

    Component.Params.Output(1).Name = "Preview Mesh"
    Component.Params.Output(1).Description = "A greyscale preview mesh reflecting the range of values"
    Component.Params.Output(2).Name = "Angle"
    Component.Params.Output(2).Description = "The angle the face normal to the connected face normals as specified by the Mode input"
    Component.Params.Output(3).Name = "Values"
    Component.Params.Output(3).Description = "The list of all associated values to each sample point"
    Component.Params.Output(4).Name = "Topology"
    Component.Params.Output(4).Description = "The list of index values connected to the sample point"
    Component.Params.Output(5).Name = "Pattern"
    Component.Params.Output(5).Description = "If the R input is used, the status of each sample point relative to the provided range (0 = Below, 1 = Within, 2 = Above)"

    If M IsNot Nothing Then
      Dim i,j,k,s As Integer

      Dim iP As Grasshopper.Kernel.IGH_Param = Component.Params.Input(0)
      Dim cP As Grasshopper.Kernel.Data.IGH_Structure = iP.VolatileData

      Dim mf As Rhino.Geometry.Collections.MeshFaceList = Nothing
      Dim mfn As Rhino.Geometry.Collections.MeshFaceNormalList = Nothing
      Dim mv As Rhino.Geometry.Collections.MeshVertexList = Nothing
      Dim mtv As Rhino.Geometry.Collections.MeshTopologyVertexList = Nothing
      Dim mte As Rhino.Geometry.Collections.MeshTopologyEdgeList = Nothing
      Dim mn As Rhino.Geometry.Collections.MeshVertexNormalList = Nothing
      Dim mc As Rhino.Geometry.Collections.MeshVertexColorList = Nothing

      If M.facenormals.count() = 0 Then M.FaceNormals.ComputeFaceNormals()

      mf = m.Faces
      mfn = m.FaceNormals
      mv = m.Vertices
      mtv = m.TopologyVertices
      mte = m.TopologyEdges
      mn = m.Normals
      mc = m.VertexColors

      Dim avgAng As New list(Of Double)
      Dim arrVal As New datatree(Of Double)
      Dim arrTop As New datatree(Of Integer)
      Dim oc As New list(Of color)
      Dim tv As Integer
      Dim aMin, aMax As Double
      Dim arrPat As New list(Of Integer)

      Dim mfo As New list(Of MeshFace)
      Dim mvo As New list(Of point3d)

      For i = 0 To mf.count() - 1 Step 1
        Dim tcv() As Integer

        tcv = mf.AdjacentFaces(i)
        s = mvo.count()

        k = ((tcv.Length - 1) + 1)

        If mf.item(i).isquad() Then
          mvo.add(mv.item(mf.item(i).A))
          mvo.add(mv.item(mf.item(i).B))
          mvo.add(mv.item(mf.item(i).C))
          mvo.add(mv.item(mf.item(i).D))
          mfo.add(New meshface(s, s + 1, s + 2, s + 3))
        Else
          mvo.add(mv.item(mf.item(i).A))
          mvo.add(mv.item(mf.item(i).B))
          mvo.add(mv.item(mf.item(i).C))
          mfo.add(New meshface(s, s + 1, s + 2))
        End If

        Dim tang,ang, tMin, tMax As New Double
        For j = 0 To k - 1 Step 1
          tang = vector3d.VectorAngle(mfn.item(i), mfn.item(tcv(j)))
          arrVal.add(tang, cp.Path(Component.RunCount - 1).AppendElement(i))
          arrTop.add(tcv(j), cp.Path(Component.RunCount - 1).AppendElement(i))
          ang += tang
          If j = 0 Then tMin = tang Else If tang < tMin Then tMin = tang
          If tang > tMax Then tMax = tang
        Next

        If O = 1 Then
          ang = tMin
        ElseIf O = 2 Then
          ang = tMax
        Else
          ang /= k
        End If

        avgAng.add(ang)

        If i = 0 Then aMin = ang Else If ang < aMin Then aMin = ang
        If ang > aMax Then aMax = ang
      Next

      If R = Nothing Then
        R.t0 = amin
        R.t1 = amax
      End If

      For i = 0 To mf.count() - 1 Step 1
        If mf.item(i).isquad() Then k = 4 Else k = 3
        If avgAng.item(i) < R.T0 Then
          For j = 0 To k - 1 Step 1
            oc.add(color.FromArgb(0, 0, 255))
          Next
          arrPat.add(0)
        ElseIf ((avgAng.item(i) > R.T1) Or ((r.t0 = 0) And (r.t1 = 0))) Then
          For j = 0 To k - 1 Step 1
            oc.add(color.FromArgb(255, 0, 0))
          Next
          arrPat.add(2)
        Else
          For j = 0 To k - 1 Step 1
            tv = math.Floor((avgAng.item(i) - R.T0) / (R.t1 - R.t0) * 255)
            oc.add(color.FromArgb(tv, tv, tv))
          Next
          arrPat.add(1)
        End If
      Next
      Dim mo As New mesh
      mo.vertices.AddVertices(mvo.toarray())
      mo.Faces.AddFaces(mfo.toarray())
      mo.VertexColors.AppendColors(oc.toarray())

      G = mo
      V = arrVal
      A = avgAng
      P = arrPat
      T = arrTop
    End If
# ---------- end face_to_face_angles ----------
meshskeleton = MeshSkeleton(Mesh=weaverbird_s_catmull_clark_subdivision)
amplitude = Amplitude(Vector=face_normals.Normals, Amplitude=10)
list_item = ListItem(List=face_normals.Normals, Index=Slider(7175, range=0..10000), Wrap=True)
deconstruct_mesh_2 = DeconstructMesh(Mesh=face_to_face_angles.G)  # -> Vertices, Faces, Colours, Normals
number_slider = Slider(33.79, range=0..100)
deconstruct_vector = DeconstructVector(Vector=face_normals.Normals)  # -> XComponent, YComponent, ZComponent
deconstruct_vector_2 = DeconstructVector(Vector=list_item)  # -> XComponent, YComponent, ZComponent
perp_frames = PerpFrames(Curve=meshskeleton, Count=10, Align=True)  # -> Frames, Parameters
custom_preview_lineweights = CustomPreviewLineweights(
    Geometry=meshskeleton,
    Shader={diffuse=RGB(132, 255, 0), emission=RGB(40, 76, 0), shine=0.5, specular=RGB(255, 255, 255), transparency=0},
    Thickness=10,
    Absolute=False)
split_ahsl = SplitAHSL(Colour=deconstruct_mesh_2.Colours)  # -> Alpha, Hue, Saturation, Luminance
vector_display = VectorDisplay(Anchor=face_normals.Centers, Vector=amplitude)  # disabled
similarity = Similarity(FirstNumber=deconstruct_vector_2.XComponent, SecondNumber=deconstruct_vector.XComponent, Threshold=number_slider)  # -> Similarity, AbsoluteDifference
similarity_2 = Similarity(FirstNumber=deconstruct_vector_2.YComponent, SecondNumber=deconstruct_vector.YComponent, Threshold=number_slider)  # -> Similarity, AbsoluteDifference
similarity_3 = Similarity(FirstNumber=deconstruct_vector_2.ZComponent, SecondNumber=deconstruct_vector.ZComponent, Threshold=number_slider)  # -> Similarity, AbsoluteDifference
smaller_than = SmallerThan(FirstNumber=split_ahsl.Luminance, SecondNumber=0.2)  # -> SmallerThan, OrEqualTo
removeduplicatepts = RemoveDuplicatePts(Points=perp_frames.Frames, Tolerance=0.01)
point = Point(perp_frames.Frames)
cull_pattern = CullPattern(List=deconstruct_mesh_2.Vertices, CullPattern=smaller_than.SmallerThan)
gate_and = GateAnd(A=similarity.Similarity, B=similarity_2.Similarity)
find_similar_member = FindSimilarMember(Data=removeduplicatepts, Set=point)  # -> Hit, Index
gate_and_2 = GateAnd(A=gate_and, B=similarity_3.Similarity)
cull_pattern_2 = CullPattern(List=mesh_explode, CullPattern=gate_and_2)
weaverbird_s_join_meshes_and_weld = WeaverbirdsJoinMeshesAndWeld(Mesh=cull_pattern_2, Weld=True)
point_groups = PointGroups(Points=cull_pattern, Distance=5)  # -> Groups, Indices
disjoint_mesh = DisjointMesh(Mesh=weaverbird_s_join_meshes_and_weld)
list_item_2 = ListItem(List=perp_frames.Frames, Index=find_similar_member.Index, Wrap=True)
duplicate_data = DuplicateData(Data=weaverbird_s_catmull_clark_subdivision, Number=3, Order=True)
mesh_explode_2 = MeshExplode(Mesh=disjoint_mesh, Interpolate=False)
plane_fit = PlaneFit(Points=point_groups.Groups)  # -> Plane, Deviation
list_length_2 = ListLength(List=mesh_explode_2)  # -> flatten(Length)
center = Center(Geometry=point_groups.Groups, forall=True)  # -> Center, Dimension
closest_point = ClosestPoint(Point=flatten(center.Center), Cloud=center.Center)  # -> ClosestPoint, CPIndex, flatten(Distance)
extend_curve = ExtendCurve(Curve=meshskeleton, Type=0, Start=10, End=10)
sort_list = SortList(Keys=list_length_2, ValuesValuesA=disjoint_mesh)  # -> Keys, ValuesValuesA
mesh_plane = MeshPlane(Mesh=duplicate_data, Plane=perp_frames.Frames)
sort_list_2 = SortList(Keys=closest_point.Distance)  # -> reverse(Keys), ValuesValuesA
trim_tree = TrimTree(Tree=mesh_plane, Depth=1)
move_to_point = MoveToPoint(Geometry=plane_fit.Plane, PointA=plane_fit.Plane, PointB=center.Center)  # -> Moved, Vector, Transform
list_item_3 = ListItem(List=sort_list.ValuesValuesA, Index=-1, Wrap=True)
panel = Panel(gate_and_2)
center_2 = Center(Geometry=trim_tree)  # -> Center, Dimension
list_item_4 = ListItem(List=sort_list_2.Keys, Index=0, Wrap=True)
bounding_box = BoundingBox(Content=weaverbird_s_catmull_clark_subdivision, Plane=PlaneXY(0, 0, 0))  # -> Box, Box_2
mesh_explode_3 = MeshExplode(Mesh=list_item_3, Interpolate=False)
curve_closest_point = CurveClosestPoint(Point=center_2.Center, Curve=graft(extend_curve))  # -> Point, Parameter, Distance
triangulate = Triangulate(Mesh=mesh_explode_3)  # -> Mesh, Count
larger_than = LargerThan(FirstNumber=curve_closest_point.Distance, SecondNumber=10)  # -> LargerThan, OrEqualTo
center_3 = Center(Geometry=flatten(center.Center), forall=True)  # -> Center, Dimension
face_boundaries = FaceBoundaries(Mesh=triangulate.Mesh)  # -> flatten(Boundaries)
cull_pattern_3 = CullPattern(List=trim_tree, CullPattern=invert(larger_than.LargerThan))
length = Length(Curve=cull_pattern_3)
boundary_surfaces = BoundarySurfaces(Edges=face_boundaries)
plane_closest_point = PlaneClosestPoint(Point=center_3.Center, Plane=flatten(move_to_point.Moved))  # -> Point, UVPoint, Distance
average = Average(Input=length)
panel_2 = Panel(larger_than.LargerThan)
average_plane = AveragePlane(Planes=boundary_surfaces)
similarity_4 = Similarity(FirstNumber=length, SecondNumber=average, Threshold=20)  # -> Similarity, AbsoluteDifference
smaller_than_2 = SmallerThan(FirstNumber=plane_closest_point.Distance, SecondNumber=0)  # -> SmallerThan, OrEqualTo
cull_pattern_4 = CullPattern(List=cull_pattern_3, CullPattern=similarity_4.Similarity)
construct_domain = ConstructDomain(DomainStart=1, DomainEnd=list_item_4)
sift_pattern = SiftPattern(List=flatten(move_to_point.Moved), SiftPattern=smaller_than_2.SmallerThan)  # -> Output0, Output1
custom_preview_lineweights_2 = CustomPreviewLineweights(
    Geometry=cull_pattern_4,
    Shader={diffuse=RGB(0, 0, 0), emission=RGB(0, 0, 0), shine=0.5, specular=RGB(255, 255, 255), transparency=0},
    Thickness=5,
    Absolute=False)
flip_plane = FlipPlane(Plane=sift_pattern.Output1, FlipX=False, FlipY=False, FlipZ=True)  # -> Flipped, ResultBoolean
range = Range(Domain=construct_domain, Steps=Slider(13, range=0..100))
combine_data = CombineData(Input0=sift_pattern.Output0, Input1=flip_plane.Flipped)  # -> Result, Index
list_item_5 = ListItem(List=combine_data.Result, Index=0, Wrap=True)  # -> Item, Item1, Item2
show_uvw_surface = ShowUVWSurface(Surfaces=combine_data.Result, Size=1)
contour_ex = ContourEx(Shape=weaverbird_s_catmull_clark_subdivision, Plane=list_item_5.Item, Offsets=range)  # -> flatten(Contours)
contour_ex_2 = ContourEx(Shape=weaverbird_s_catmull_clark_subdivision, Plane=list_item_5.Item2, Offsets=range)  # -> flatten(Contours)
contour_ex_3 = ContourEx(Shape=weaverbird_s_catmull_clark_subdivision, Plane=list_item_5.Item1, Offsets=range)  # -> flatten(Contours)
custom_preview_lineweights_3 = CustomPreviewLineweights(Geometry=contour_ex, Shader=ColourSwatch(SwatchColor=RGB(93, 255, 0)), Thickness=5, Absolute=False)
custom_preview_lineweights_4 = CustomPreviewLineweights(Geometry=contour_ex_2, Shader=ColourSwatch(SwatchColor=RGB(93, 0, 255)), Thickness=5, Absolute=False)  # disabled
custom_preview_lineweights_5 = CustomPreviewLineweights(Geometry=contour_ex_3, Shader=ColourSwatch(SwatchColor=RGB(255, 0, 0)), Thickness=5, Absolute=False)
multiple_curves = MultipleCurves(Curves=[contour_ex, contour_ex_3])  # -> Points, IndexA, IndexB, ParamA, ParamB; disabled
curve_curve = CurveCurve(CurveA=graft(contour_ex), CurveB=contour_ex_3)  # -> Points, ParamsA, ParamsB
