# Grasshopper definition TreeSkeletonV2.gh (Grasshopper 1.0.7)
# plug-ins: Pufferfish, Human, Heteroptera, CockroachGH, Kangaroo2 Components, Flexibility

mesh = Mesh(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)
mesh_2 = Mesh(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)  # disabled
mesh_3 = Mesh(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)  # disabled
mesh_4 = Mesh(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)  # disabled

# ---- group: Mesh Preview & Control
mesh_edges = MeshEdges(Mesh=mesh)  # -> NakedEdges, InteriorEdges, NonManifoldEdges
# Tree Skeleton (Simplified)
custom_preview = CustomPreview(
    Geometry=[mesh_edges.InteriorEdges, mesh],
    Material={diffuse=RGB(222, 160, 222), emission=RGB(67, 48, 67), shine=0.5, specular=RGB(255, 255, 255), transparency=0.6705882353})
is_mesh_closed = IsMeshClosed(Mesh=mesh)
panel = Panel(is_mesh_closed)

mesh_edges_2 = MeshEdges(Mesh=mesh_4)  # -> NakedEdges, InteriorEdges, NonManifoldEdges; disabled
# Tree Skeleton (Full)
# Extract the skeleton of the 3D scan; generate sections and calibration planes for the robotic milling.
# Plugins: Pufferfish; Weaverbird; Heteroptera; Flexibility; Cockroach; Human; Mesh+
custom_preview_2 = CustomPreview(
    Geometry=[mesh_4, mesh_edges_2.InteriorEdges],
    Material={diffuse=RGB(222, 160, 222), emission=RGB(67, 48, 67), shine=0.5, specular=RGB(255, 255, 255), transparency=0.6705882353})  # disabled
is_mesh_closed_2 = IsMeshClosed(Mesh=mesh_4)  # disabled
panel_2 = Panel(is_mesh_closed_2)  # disabled

# ----
tree_fork_profiler = TreeForkProfiler(relay=mesh)  # -> plane_2, curve_2
meshskeleton = MeshSkeleton(Mesh=mesh_4)  # disabled
end_points = EndPoints(Curve=meshskeleton)  # -> Start, End; disabled
show_uvw_surface = ShowUVWSurface(Surfaces=tree_fork_profiler.plane_2, Size=1)
multiple_curves = MultipleCurves(Curves=meshskeleton)  # -> Points, IndexA, IndexB, ParamA, ParamB; disabled
custom_preview_lineweights = CustomPreviewLineweights(
    Geometry=tree_fork_profiler.curve_2,
    Shader=[ColourSwatch(SwatchColor=RGB(132, 255, 0)), ColourSwatch(SwatchColor=RGB(72, 0, 255)), ColourSwatch(SwatchColor=RGB(255, 0, 0))],
    Thickness=10,
    Absolute=False)
removeduplicatepts = RemoveDuplicatePts(Points=multiple_curves.Points, Tolerance=0.01)  # disabled
closest_point = ClosestPoint(Point=end_points.Start, Cloud=removeduplicatepts)  # -> ClosestPoint, CPIndex, Distance; disabled
equality = Equality(FirstNumber=closest_point.Distance, SecondNumber=0)  # -> Equality, Inequality; disabled
sift_pattern = SiftPattern(List=flatten(meshskeleton), SiftPattern=equality.Inequality)  # -> Output0, Output1; disabled
flip_curve = FlipCurve(Curve=sift_pattern.Output1)  # -> Curve, Flag; disabled
combine_data = CombineData(Input0=sift_pattern.Output0, Input1=flip_curve.Curve)  # -> Result, Index; disabled

# ---- group: Curve Dir. Preview
end_points_2 = EndPoints(Curve=combine_data.Result)  # -> Start, End; disabled
line = Line(StartPoint=end_points_2.Start, EndPoint=end_points_2.End)  # disabled
vector_display = VectorDisplay(Anchor=end_points_2.Start, Vector=line)  # disabled

# ----
extend_curve = ExtendCurve(Curve=combine_data.Result, Type=0, Start=0, End=100)  # disabled
mesh_curve = MeshCurve(Mesh=mesh_4, Curve=extend_curve)  # -> Points, Faces; disabled
curve_closest_point = CurveClosestPoint(Point=mesh_curve.Points, Curve=graft(extend_curve))  # -> Point, Parameter, Distance; disabled
shatter = Shatter(Curve=graft(extend_curve), Parameters=curve_closest_point.Parameter)  # disabled
length = Length(Curve=shatter)  # disabled
sort_list = SortList(Keys=length, ValuesValuesA=shatter)  # -> Keys, ValuesValuesA; disabled
dispatch = Dispatch(List=sort_list.ValuesValuesA, DispatchPattern=[True, False])  # -> ListA, flatten(ListB); disabled

# ---- group: Tree Fork Skeleton Line & Preview
colour_swatch = ColourSwatch(SwatchColor=RGB(132, 255, 0))  # disabled
colour_swatch_2 = ColourSwatch(SwatchColor=RGB(72, 0, 255))  # disabled
colour_swatch_3 = ColourSwatch(SwatchColor=RGB(255, 0, 0))  # disabled
curve = Curve(dispatch.ListB)  # disabled
custom_preview_lineweights_2 = CustomPreviewLineweights(Geometry=curve, Shader=[colour_swatch, colour_swatch_2, colour_swatch_3], Thickness=10, Absolute=False)  # disabled

# ----
perp_frame = PerpFrame(Curve=reparameterize(dispatch.ListB), Parameter=1)  # -> flatten(Frame); disabled
deconstruct_plane = DeconstructPlane(Plane=perp_frame)  # -> Origin, XAxis, YAxis, ZAxis; disabled
line_sdl = LineSDL(Start=deconstruct_plane.Origin, Direction=deconstruct_plane.YAxis, Length=50)  # disabled
line_sdl_2 = LineSDL(Start=deconstruct_plane.Origin, Direction=deconstruct_plane.ZAxis, Length=50)  # disabled
project = Project(Geometry=line_sdl, Plane=Plane(origin=(0, 0, 0), x=(0, 0, 1), y=(1, 0, 0)))  # -> Geometry, Transform; disabled
project_2 = Project(Geometry=line_sdl_2, Plane=PlaneXY(0, 0, 0))  # -> Geometry, Transform; disabled
angle = Angle(VectorA=Vector(0, 0, 1), VectorB=project.Geometry)  # -> Angle, Reflex; disabled
angle_2 = Angle(VectorA=Vector(0, 1, 0), VectorB=project_2.Geometry)  # -> Angle, Reflex; disabled
degrees = Degrees(Radians=angle.Angle)  # disabled
degrees_2 = Degrees(Radians=angle_2.Angle)  # disabled
expression = Expression(x=degrees_2, Expression="If(x>90, +90, 0)")  # disabled
addition = Addition(A=degrees, B=expression)  # disabled
rotate_plane = RotatePlane(Plane=perp_frame, Angle=expr("x-180", degrees(addition)))  # disabled

# ---- group: Calibbration Planes (Fork End Points)
plane = Plane(rotate_plane)  # disabled
show_uvw_surface_2 = ShowUVWSurface(Surfaces=plane, Size=1)  # disabled

# ---- group: Sections Generator
number_slider = Slider(10, range=0..100)  # disabled
extend_curve_2 = ExtendCurve(Curve=dispatch.ListB, Type=0, Start=0, End=-5)  # disabled
perp_frames = PerpFrames(Curve=extend_curve_2, Count=number_slider, Align=True)  # -> Frames, Parameters; disabled
mesh_plane = MeshPlane(Mesh=mesh_4, Plane=perp_frames.Frames)  # disabled
trim_tree = TrimTree(Tree=mesh_plane, Depth=1)  # disabled

# ---- group: Filter 1 (Wrong Intersection Location)
center = Center(Geometry=trim_tree)  # -> Center, Dimension; disabled
number_slider_2 = Slider(22, range=0..100)  # disabled
curve_closest_point_2 = CurveClosestPoint(Point=center.Center, Curve=graft(dispatch.ListB))  # -> Point, Parameter, Distance; disabled
larger_than = LargerThan(FirstNumber=curve_closest_point_2.Distance, SecondNumber=number_slider_2)  # -> LargerThan, OrEqualTo; disabled
cull_pattern = CullPattern(List=trim_tree, CullPattern=invert(larger_than.LargerThan))  # disabled

# ---- group: Filter 2 (Odd Size at Bifurcation)
length_2 = Length(Curve=cull_pattern)  # disabled
number_slider_3 = Slider(20, range=0..100)  # disabled
average = Average(Input=length_2)  # disabled
similarity = Similarity(FirstNumber=length_2, SecondNumber=average, Threshold=number_slider_3)  # -> Similarity, AbsoluteDifference; disabled
cull_pattern_2 = CullPattern(List=cull_pattern, CullPattern=similarity.Similarity)  # disabled

# ----
custom_preview_lineweights_3 = CustomPreviewLineweights(
    Geometry=cull_pattern_2,
    Shader={diffuse=RGB(0, 0, 0), emission=RGB(0, 0, 0), shine=0.5, specular=RGB(255, 255, 255), transparency=0},
    Thickness=5,
    Absolute=False)  # disabled

# ==== cluster TreeForkProfiler
relay = ClusterInput()
meshskeleton = MeshSkeleton(Mesh=relay)
end_points = EndPoints(Curve=meshskeleton)  # -> Start, End
multiple_curves = MultipleCurves(Curves=meshskeleton)  # -> Points, IndexA, IndexB, ParamA, ParamB
removeduplicatepts = RemoveDuplicatePts(Points=multiple_curves.Points, Tolerance=0.01)
closest_point = ClosestPoint(Point=end_points.Start, Cloud=removeduplicatepts)  # -> ClosestPoint, CPIndex, Distance
equality = Equality(FirstNumber=closest_point.Distance, SecondNumber=0)  # -> Equality, Inequality
sift_pattern = SiftPattern(List=flatten(meshskeleton), SiftPattern=equality.Inequality)  # -> Output0, Output1
flip_curve = FlipCurve(Curve=sift_pattern.Output1)  # -> Curve, Flag
combine_data = CombineData(Input0=sift_pattern.Output0, Input1=flip_curve.Curve)  # -> Result, Index
end_points_2 = EndPoints(Curve=combine_data.Result)  # -> Start, End
line = Line(StartPoint=end_points_2.Start, EndPoint=end_points_2.End)
extend_curve = ExtendCurve(Curve=combine_data.Result, Type=0, Start=0, End=100)
vector_display = VectorDisplay(Anchor=end_points_2.Start, Vector=line)
mesh_curve = MeshCurve(Mesh=relay, Curve=extend_curve)  # -> Points, Faces
curve_closest_point = CurveClosestPoint(Point=mesh_curve.Points, Curve=graft(extend_curve))  # -> Point, Parameter, Distance
shatter = Shatter(Curve=graft(extend_curve), Parameters=curve_closest_point.Parameter)
length = Length(Curve=shatter)
sort_list = SortList(Keys=length, ValuesValuesA=shatter)  # -> Keys, ValuesValuesA
dispatch = Dispatch(List=sort_list.ValuesValuesA, DispatchPattern=[True, False])  # -> ListA, flatten(ListB)
perp_frame = PerpFrame(Curve=reparameterize(dispatch.ListB), Parameter=1)  # -> flatten(Frame)
curve = Curve(dispatch.ListB)
curve_2 = ClusterOutput(curve)
deconstruct_plane = DeconstructPlane(Plane=perp_frame)  # -> Origin, XAxis, YAxis, ZAxis
line_sdl = LineSDL(Start=deconstruct_plane.Origin, Direction=deconstruct_plane.YAxis, Length=50)
line_sdl_2 = LineSDL(Start=deconstruct_plane.Origin, Direction=deconstruct_plane.ZAxis, Length=50)
project = Project(Geometry=line_sdl, Plane=Plane(origin=(0, 0, 0), x=(0, 0, 1), y=(1, 0, 0)))  # -> Geometry, Transform
project_2 = Project(Geometry=line_sdl_2, Plane=PlaneXY(0, 0, 0))  # -> Geometry, Transform
angle = Angle(VectorA=Vector(0, 0, 1), VectorB=project.Geometry)  # -> Angle, Reflex
angle_2 = Angle(VectorA=Vector(0, 1, 0), VectorB=project_2.Geometry)  # -> Angle, Reflex
degrees = Degrees(Radians=angle.Angle)
degrees_2 = Degrees(Radians=angle_2.Angle)
expression = Expression(x=degrees_2, Expression="If(x>90, +90, 0)")
addition = Addition(A=degrees, B=expression)
rotate_plane = RotatePlane(Plane=perp_frame, Angle=expr("x-180", degrees(addition)))
plane = Plane(rotate_plane)
show_uvw_surface = ShowUVWSurface(Surfaces=plane, Size=1)
plane_2 = ClusterOutput(plane)
