# Grasshopper definition Fork_Dataset.gh (Grasshopper 1.0.7)
# plug-ins: Heteroptera, Human, Flexibility

# 3D Scan Import and Scaling
# 1.1 Create a new fork layer
# 
# 1.2 Input layer digit into the big panel
# 
# 1.3 Import High/Low Poly into corresponding sublayers
# 
# 1.4 Hide Low Poly and mark the Points
# 
# 1.5 Show Low Poly
# 
# 1.6 Group Low Poly + High Poly + 3 Points
# 
# 1.7 Scale the group according to the guide and orient it correctly
# 
# 
# 
# 
# 2.1 Duplicate the script.
# 
# 2.2 Increament the number in the panel for the new scan
# 
# 2.3 Repeat all the above with a new fork
# 
# 
# 
# 
# 3.1 You can start making assemblies
# 
# 
# 
# 
# NB:
# Save both file Rhino (7 not 8) and Grasshopper in
# https://drive.google.com/drive/u/0/folders/13nQTXaapD7pjCw7jiYSdxXGD1Lmxpe9S
# Format: Fork_##;##;##
panel = Panel("01")
concatenate = Concatenate(FragmentA="Skeleton(Auto)_", FragmentB=graft(panel))  # -> flatten(Result)
concatenate_2 = Concatenate(FragmentA="Skeleton(Auto)_", FragmentB=graft("02"))  # -> flatten(Result)
concatenate_3 = Concatenate(FragmentA="Skeleton(Auto)_", FragmentB=graft("03"))  # -> flatten(Result)
concatenate_4 = Concatenate(FragmentA="Skeleton(Auto)_", FragmentB=graft("04"))  # -> flatten(Result)
concatenate_5 = Concatenate(FragmentA="Skeleton(Auto)_", FragmentB=graft("05"))  # -> flatten(Result)
concatenate_6 = Concatenate(FragmentA="Points_", FragmentB=graft(panel))  # -> flatten(Result)
concatenate_7 = Concatenate(FragmentA="Points_", FragmentB=graft("02"))  # -> flatten(Result)
concatenate_8 = Concatenate(FragmentA="Points_", FragmentB=graft("03"))  # -> flatten(Result)
concatenate_9 = Concatenate(FragmentA="Points_", FragmentB=graft("04"))  # -> flatten(Result)
concatenate_10 = Concatenate(FragmentA=["HighPoly_", "LowPoly_"], FragmentB=graft(panel))  # -> flatten(Result)
concatenate_11 = Concatenate(FragmentA="Points_", FragmentB=graft("05"))  # -> flatten(Result)
concatenate_12 = Concatenate(FragmentA=["HighPoly_", "LowPoly_"], FragmentB=graft("02"))  # -> flatten(Result)
concatenate_13 = Concatenate(FragmentA=["HighPoly_", "LowPoly_"], FragmentB=graft("03"))  # -> flatten(Result)
concatenate_14 = Concatenate(FragmentA=["HighPoly_", "LowPoly_"], FragmentB=graft("04"))  # -> flatten(Result)
concatenate_15 = Concatenate(FragmentA=["HighPoly_", "LowPoly_"], FragmentB=graft("05"))  # -> flatten(Result)

# ---- group: Grid
curve = Curve([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])
custom_preview_lineweights = CustomPreviewLineweights(
    Geometry=curve,
    Shader={diffuse=RGB(0, 0, 0), emission=RGB(0, 0, 0), shine=0.5, specular=RGB(255, 255, 255), transparency=0},
    Absolute=False)

# ---- group: Create New Fork Layer
create_new_fork_layer = GhPythonScript(Run=Button(), Reset=False, Color=ColourSwatch(SwatchColor=RGBA(0, 255, 255, 14)))  # inputs Run: Boolean, Reset: Boolean, Color: Color
# ---------- create_new_fork_layer: Python ----------
import scriptcontext as sc
import Rhino

# Switch to Rhino document
sc.doc = Rhino.RhinoDoc.ActiveDoc

if Reset:
    sc.sticky["ForkLayerCounter"] = 0
    a = "Counter reset to 0."

elif Run:
    # Initialize counter if not set
    if "ForkLayerCounter" not in sc.sticky:
        sc.sticky["ForkLayerCounter"] = 1
    else:
        sc.sticky["ForkLayerCounter"] += 1

    index = sc.sticky["ForkLayerCounter"]
    layer_number = str(index).zfill(2)

    # Define names
    main_layer_name = "Fork_" + layer_number
    sublayers = [
        "HighPoly_" + layer_number,
        "LowPoly_" + layer_number,
        "Points_" + layer_number,
        "Skeleton(Auto)_" + layer_number
    ]

    # Access Rhino layer table
    layers = sc.doc.Layers

    # Create main layer (no color change)
    if layers.FindByFullPath(main_layer_name, -1) == -1:
        parent_layer = Rhino.DocObjects.Layer()
        parent_layer.Name = main_layer_name
        layers.Add(parent_layer)

    parent_index = layers.FindByFullPath(main_layer_name, -1)

    # Create sublayers with selective color assignment
    for sub in sublayers:
        full_name = main_layer_name + "::" + sub
        if layers.FindByFullPath(full_name, -1) == -1:
            sub_layer = Rhino.DocObjects.Layer()
            sub_layer.Name = sub
            sub_layer.ParentLayerId = layers[parent_index].Id

            # Set color for HighPoly / LowPoly only
            if "HighPoly" in sub or "LowPoly" in sub:
                sub_layer.Color = Color  # Use the Grasshopper input color

            layers.Add(sub_layer)

    sc.doc.Views.Redraw()

    a = "Created Fork_{} hierarchy. High/LowPoly colored.".format(layer_number)

else:
    a = "Waiting for Run or Reset."

# Restore context to Grasshopper
sc.doc = ghdoc
# ---------- end create_new_fork_layer ----------

# ----
panel_2 = Panel(concatenate)
panel_3 = Panel(concatenate_2)
panel_4 = Panel(concatenate_10)
panel_5 = Panel(concatenate_3)
panel_6 = Panel(concatenate_6)
panel_7 = Panel(concatenate_12)
panel_8 = Panel(concatenate_4)
panel_9 = Panel(concatenate_7)
panel_10 = Panel(concatenate_13)
panel_11 = Panel(concatenate_5)
panel_12 = Panel(concatenate_8)
panel_13 = Panel(concatenate_14)
panel_14 = Panel(concatenate_9)
panel_15 = Panel(concatenate_15)
panel_16 = Panel(concatenate_11)
mesh = DynamicGeometryPipeline(
    LayerFilter=panel_4,
    TypeFilter=["Point", "Curve", "Mesh"],
    NameFilter="*",
    GroupByLayer=False,
    GroupByType=False,
    IncludeHidden=True,
    IncludeLocked=True,
    enableFullPath=False,
    listenToAttributes=True)  # -> flatten(GeometryOut)
points = DynamicGeometryPipeline(
    LayerFilter=panel_6,
    TypeFilter=["Point", "Curve", "Mesh"],
    NameFilter="*",
    GroupByLayer=False,
    GroupByType=False,
    IncludeHidden=True,
    IncludeLocked=True,
    enableFullPath=False,
    listenToAttributes=True)  # -> flatten(GeometryOut)
mesh_2 = DynamicGeometryPipeline(
    LayerFilter=panel_7,
    TypeFilter=["Point", "Curve", "Mesh"],
    NameFilter="*",
    GroupByLayer=False,
    GroupByType=False,
    IncludeHidden=True,
    IncludeLocked=True,
    enableFullPath=False,
    listenToAttributes=True)  # -> flatten(GeometryOut)
points_2 = DynamicGeometryPipeline(
    LayerFilter=panel_9,
    TypeFilter=["Point", "Curve", "Mesh"],
    NameFilter="*",
    GroupByLayer=False,
    GroupByType=False,
    IncludeHidden=True,
    IncludeLocked=True,
    enableFullPath=False,
    listenToAttributes=True)  # -> flatten(GeometryOut)
dynamic_geometry_pipeline = DynamicGeometryPipeline(
    LayerFilter=panel_2,
    TypeFilter=["Point", "Curve"],
    NameFilter=["0", "1", "2"],
    GroupByLayer=False,
    GroupByType=False,
    IncludeHidden=True,
    IncludeLocked=True,
    enableFullPath=False,
    listenToAttributes=True)  # -> flatten(GeometryOut)
mesh_3 = DynamicGeometryPipeline(
    LayerFilter=panel_10,
    TypeFilter=["Point", "Curve", "Mesh"],
    NameFilter="*",
    GroupByLayer=False,
    GroupByType=False,
    IncludeHidden=True,
    IncludeLocked=True,
    enableFullPath=False,
    listenToAttributes=True)  # -> flatten(GeometryOut)
points_3 = DynamicGeometryPipeline(
    LayerFilter=panel_12,
    TypeFilter=["Point", "Curve", "Mesh"],
    NameFilter="*",
    GroupByLayer=False,
    GroupByType=False,
    IncludeHidden=True,
    IncludeLocked=True,
    enableFullPath=False,
    listenToAttributes=True)  # -> flatten(GeometryOut)
dynamic_geometry_pipeline_2 = DynamicGeometryPipeline(
    LayerFilter=panel_3,
    TypeFilter=["Point", "Curve"],
    NameFilter=["0", "1", "2"],
    GroupByLayer=False,
    GroupByType=False,
    IncludeHidden=True,
    IncludeLocked=True,
    enableFullPath=False,
    listenToAttributes=True)  # -> flatten(GeometryOut)
mesh_4 = DynamicGeometryPipeline(
    LayerFilter=panel_13,
    TypeFilter=["Point", "Curve", "Mesh"],
    NameFilter="*",
    GroupByLayer=False,
    GroupByType=False,
    IncludeHidden=True,
    IncludeLocked=True,
    enableFullPath=False,
    listenToAttributes=True)  # -> flatten(GeometryOut)
points_4 = DynamicGeometryPipeline(
    LayerFilter=panel_14,
    TypeFilter=["Point", "Curve", "Mesh"],
    NameFilter="*",
    GroupByLayer=False,
    GroupByType=False,
    IncludeHidden=True,
    IncludeLocked=True,
    enableFullPath=False,
    listenToAttributes=True)  # -> flatten(GeometryOut)
dynamic_geometry_pipeline_3 = DynamicGeometryPipeline(
    LayerFilter=panel_5,
    TypeFilter=["Point", "Curve"],
    NameFilter=["0", "1", "2"],
    GroupByLayer=False,
    GroupByType=False,
    IncludeHidden=True,
    IncludeLocked=True,
    enableFullPath=False,
    listenToAttributes=True)  # -> flatten(GeometryOut)
mesh_5 = DynamicGeometryPipeline(
    LayerFilter=panel_15,
    TypeFilter=["Point", "Curve", "Mesh"],
    NameFilter="*",
    GroupByLayer=False,
    GroupByType=False,
    IncludeHidden=True,
    IncludeLocked=True,
    enableFullPath=False,
    listenToAttributes=True)  # -> flatten(GeometryOut)
points_5 = DynamicGeometryPipeline(
    LayerFilter=panel_16,
    TypeFilter=["Point", "Curve", "Mesh"],
    NameFilter="*",
    GroupByLayer=False,
    GroupByType=False,
    IncludeHidden=True,
    IncludeLocked=True,
    enableFullPath=False,
    listenToAttributes=True)  # -> flatten(GeometryOut)
dynamic_geometry_pipeline_4 = DynamicGeometryPipeline(
    LayerFilter=panel_8,
    TypeFilter=["Point", "Curve"],
    NameFilter=["0", "1", "2"],
    GroupByLayer=False,
    GroupByType=False,
    IncludeHidden=True,
    IncludeLocked=True,
    enableFullPath=False,
    listenToAttributes=True)  # -> flatten(GeometryOut)
dynamic_geometry_pipeline_5 = DynamicGeometryPipeline(
    LayerFilter=panel_11,
    TypeFilter=["Point", "Curve"],
    NameFilter=["0", "1", "2"],
    GroupByLayer=False,
    GroupByType=False,
    IncludeHidden=True,
    IncludeLocked=True,
    enableFullPath=False,
    listenToAttributes=True)  # -> flatten(GeometryOut)
list_item = ListItem(List=mesh, Index=1, Wrap=True)
list_item_2 = ListItem(List=mesh_2, Index=1, Wrap=True)
list_item_3 = ListItem(List=mesh_3, Index=1, Wrap=True)
list_item_4 = ListItem(List=mesh_4, Index=1, Wrap=True)
list_item_5 = ListItem(List=mesh_5, Index=1, Wrap=True)
skeleton = Skeleton(mesh=list_item, passing_switch=Button(), point=points)  # -> curve_2, plane_2
skeleton_2 = Skeleton(mesh=list_item_2, passing_switch=Button(), point=points_2)  # -> curve_2, plane_2
skeleton_3 = Skeleton(mesh=list_item_3, passing_switch=Button(), point=points_3)  # -> curve_2, plane_2
skeleton_4 = Skeleton(mesh=list_item_4, passing_switch=Button(), point=points_4)  # -> curve_2, plane_2
skeleton_5 = Skeleton(mesh=list_item_5, passing_switch=Button(), point=points_5)  # -> curve_2, plane_2
curve_2 = Curve([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])
plane = Plane([Plane(origin=(362.7561082, 2087.715416, 0), x=(-0.001936036553, 0.05856908847, -0.9982814802), y=(0.9992915245, -0.03740814863, -0.004132728261)), Plane(origin=(311.120263, 2814.028767, 0), x=(0.9934555654, 0.1141271655, -0.004585816343), y=(0.001235724509, -0.05088629917, -0.9987036886)), Plane(origin=(403.5277361, 2830.322697, 0), x=(0.9978703017, -0.06462759357, 0.008839402957), y=(-0.002171402516, -0.1683491265, -0.9857250411))])
curve_3 = Curve([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])
plane_2 = Plane([Plane(origin=(1197.442925, 2895.249922, 0), x=(0.9594521616, -0.2800046498, 0.03238743131), y=(-0.001603739663, -0.1203222959, -0.9927335862)), Plane(origin=(890.8868113, 2969.035421, 0), x=(0.9820398653, 0.1850002741, 0.03704863797), y=(0.0258661142, 0.06249847291, -0.99770982)), Plane(origin=(1005.599768, 2032.395767, 0), x=(-5.994984285e-05, 0.1543475326, -0.9880166171), y=(0.9924856081, -0.1208859211, -0.01894496781))])
curve_4 = Curve([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])
plane_3 = Plane([Plane(origin=(1738.601348, 2108.207533, 0), x=(0.01312912678, 0.1610054853, -0.9868661813), y=(0.9967409834, -0.08066846977, 9.958049383e-05)), Plane(origin=(1636.1481, 2830.087427, 0), x=(0.866329837, 0.3474699106, -0.3587997696), y=(-0.3880026407, 0.01581776601, -0.9215225169)), Plane(origin=(1785.501261, 2840.651129, 0), x=(0.9999708924, -0.007626038261, -0.0002406736606), y=(0.0003180440389, 0.07317864509, -0.997318798))])
curve_5 = Curve([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])
plane_4 = Plane([Plane(origin=(2612.914473, 2859.504105, 0), x=(0.9088295235, -0.4171308307, -0.005546817349), y=(0.002800339078, 0.0193962717, -0.9998079529)), Plane(origin=(2421.37985, 2100.248024, 0), x=(-0.01363079797, 0.08341993224, -0.9964212544), y=(0.9966706472, -0.07897916152, -0.02024630893)), Plane(origin=(2291.621433, 2915.406817, 0), x=(0.9356411911, 0.351788061, 0.02864823992), y=(0.001708756382, 0.07665163529, -0.9970564713))])
curve_6 = Curve([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])
plane_5 = Plane([Plane(origin=(3132.477045, 2795.981066, 0), x=(0.9987523115, 0.04929424747, 0.007993583674), y=(5.716061087e-05, 0.1589410713, -0.9872880697)), Plane(origin=(3220.61061, 2131.015303, 0), x=(-0.02210267937, 0.03963187817, -0.9989698623), y=(0.9862990459, 0.1642556628, -0.0153058583)), Plane(origin=(3221.706907, 2802.148044, 0), x=(0.995302774, 0.09653160081, 0.007351067558), y=(2.389467071e-05, 0.07568712603, -0.9971316154))])

# ---- group: Calibratiom Planes
show_uvw_surface = ShowUVWSurface(Surfaces=plane, Density=5)
plane_6 = Plane(plane)
enumerator = Enumerator(Object=plane_6)  # -> Numbers, Color

show_uvw_surface_2 = ShowUVWSurface(Surfaces=plane_2, Density=5)
plane_7 = Plane(plane_2)
enumerator_2 = Enumerator(Object=plane_7)  # -> Numbers, Color

show_uvw_surface_3 = ShowUVWSurface(Surfaces=plane_3, Density=5)
plane_8 = Plane(plane_3)
enumerator_3 = Enumerator(Object=plane_8)  # -> Numbers, Color

# ---- group: Skeleton
random_color = GhPythonScript(Run=Button())  # -> Color
# ---------- random_color: Python ----------
import random
import scriptcontext
from System.Drawing import Color

# Inputs:
# Run : Boolean from Button (True only when clicked)
# Seed : optional number for random seed

# Initialize sticky storage if needed
if 'last_color' not in scriptcontext.sticky:
    scriptcontext.sticky['last_color'] = Color.FromArgb(255, 255, 255)  # Default color (white)

if Run:
    if Seed is not None:
        random.seed(Seed)
    r = random.randint(0, 255)
    g = random.randint(0, 255)
    b = random.randint(0, 255)
    
    new_color = Color.FromArgb(r, g, b)
    scriptcontext.sticky['last_color'] = new_color  # Store color persistently

# Always output the last stored color
Color = scriptcontext.sticky['last_color']
# ---------- end random_color ----------
curve_7 = Curve(curve_2)
custom_preview_lineweights_2 = CustomPreviewLineweights(Geometry=curve_7, Shader=random_color, Thickness=10, Absolute=False)

# ---- group: Calibratiom Planes
show_uvw_surface_4 = ShowUVWSurface(Surfaces=plane_4, Density=5)
plane_9 = Plane(plane_4)
enumerator_4 = Enumerator(Object=plane_9)  # -> Numbers, Color

# ---- group: Skeleton
random_color_2 = GhPythonScript(Run=Button())  # -> Color; same code as random_color
curve_8 = Curve(curve_4)
custom_preview_lineweights_3 = CustomPreviewLineweights(Geometry=curve_8, Shader=random_color_2, Thickness=10, Absolute=False)

# ---- group: Calibratiom Planes
show_uvw_surface_5 = ShowUVWSurface(Surfaces=plane_5, Density=5)
plane_10 = Plane(plane_5)
enumerator_5 = Enumerator(Object=plane_10)  # -> Numbers, Color

# ---- group: Skeleton
random_color_3 = GhPythonScript(Run=Button())  # -> Color; same code as random_color
curve_9 = Curve(curve_5)
custom_preview_lineweights_4 = CustomPreviewLineweights(Geometry=curve_9, Shader=random_color_3, Thickness=10, Absolute=False)

random_color_4 = GhPythonScript(Run=Button())  # -> Color; same code as random_color
curve_10 = Curve(curve_6)
custom_preview_lineweights_5 = CustomPreviewLineweights(Geometry=curve_10, Shader=random_color_4, Thickness=10, Absolute=False)

# ----
point = Point(plane_6)
curve_11 = Curve(curve_7)
point_2 = Point(plane_7)
point_3 = Point(plane_8)
curve_12 = Curve(curve_8)
point_4 = Point(plane_9)
curve_13 = Curve(curve_9)
point_5 = Point(plane_10)
curve_14 = Curve(curve_10)
merge = Merge(Data1=point, Data2=curve_11)

# ---- group: Bake to Move Around
createattributes = CreateAttributes(Name=["0", "1", "2", "3", "4", "5"], LayerName=panel_2, GroupIndices=0, enableFullPath=False)
bake_geometry = BakeGeometry(Bake=Button(), Geometry=merge, Attributes=createattributes, DeleteOldBakes=False, PreserveTrees=False)

# ----
merge_2 = Merge(Data1=point_3, Data2=curve_12)

# ---- group: Bake to Move Around
createattributes_2 = CreateAttributes(Name=["0", "1", "2", "3", "4", "5"], LayerName=panel_5, GroupIndices=0, enableFullPath=False)
bake_geometry_2 = BakeGeometry(Bake=Button(), Geometry=merge_2, Attributes=createattributes_2, DeleteOldBakes=False, PreserveTrees=False)

# ----
merge_3 = Merge(Data1=point_4, Data2=curve_13)

# ---- group: Bake to Move Around
createattributes_3 = CreateAttributes(Name=["0", "1", "2", "3", "4", "5"], LayerName=panel_8, GroupIndices=0, enableFullPath=False)
bake_geometry_3 = BakeGeometry(Bake=Button(), Geometry=merge_3, Attributes=createattributes_3, DeleteOldBakes=False, PreserveTrees=False)

# ----
merge_4 = Merge(Data1=point_5, Data2=curve_14)

# ---- group: Bake to Move Around
createattributes_4 = CreateAttributes(Name=["0", "1", "2", "3", "4", "5"], LayerName=panel_11, GroupIndices=0, enableFullPath=False)
bake_geometry_4 = BakeGeometry(Bake=Button(), Geometry=merge_4, Attributes=createattributes_4, DeleteOldBakes=False, PreserveTrees=False)

# ----
meshes = Group(Objects=mesh)
planes = Group(Objects=plane_6)
skeleton_6 = Group(Objects=curve_7)
meshes_2 = Group(Objects=mesh_2)
planes_2 = Group(Objects=plane_7)
list_item_6 = ListItem(List=plane_6, Index=0, Wrap=True)  # -> Item, Item1, Item2
list_item_7 = ListItem(List=dynamic_geometry_pipeline, Index=0, Wrap=True)  # -> Item, Item1, Item2
meshes_3 = Group(Objects=mesh_3)
planes_3 = Group(Objects=plane_8)
skeleton_7 = Group(Objects=curve_8)
list_item_8 = ListItem(List=plane_7, Index=0, Wrap=True)  # -> Item, Item1, Item2
list_item_9 = ListItem(List=dynamic_geometry_pipeline_2, Index=0, Wrap=True)  # -> Item, Item1, Item2
meshes_4 = Group(Objects=mesh_4)
planes_4 = Group(Objects=plane_9)
skeleton_8 = Group(Objects=curve_9)
list_item_10 = ListItem(List=plane_8, Index=0, Wrap=True)  # -> Item, Item1, Item2
list_item_11 = ListItem(List=dynamic_geometry_pipeline_3, Index=0, Wrap=True)  # -> Item, Item1, Item2
meshes_5 = Group(Objects=mesh_5)
planes_5 = Group(Objects=plane_10)
skeleton_9 = Group(Objects=curve_10)
list_item_12 = ListItem(List=plane_9, Index=0, Wrap=True)  # -> Item, Item1, Item2
list_item_13 = ListItem(List=dynamic_geometry_pipeline_4, Index=0, Wrap=True)  # -> Item, Item1, Item2
list_item_14 = ListItem(List=plane_10, Index=0, Wrap=True)  # -> Item, Item1, Item2
list_item_15 = ListItem(List=dynamic_geometry_pipeline_5, Index=0, Wrap=True)  # -> Item, Item1, Item2
plane_3pt = Plane3Pt(PointA=list_item_6.Item, PointB=list_item_6.Item1, PointC=list_item_6.Item2)
plane_3pt_2 = Plane3Pt(PointA=list_item_7.Item, PointB=list_item_7.Item1, PointC=list_item_7.Item2)
merge_5 = Merge(Data1=meshes, Data2=planes, Data3=skeleton_6)  # -> flatten(Result)
plane_3pt_3 = Plane3Pt(PointA=list_item_8.Item, PointB=list_item_8.Item1, PointC=list_item_8.Item2)
plane_3pt_4 = Plane3Pt(PointA=list_item_9.Item, PointB=list_item_9.Item1, PointC=list_item_9.Item2)
plane_3pt_5 = Plane3Pt(PointA=list_item_10.Item, PointB=list_item_10.Item1, PointC=list_item_10.Item2)
plane_3pt_6 = Plane3Pt(PointA=list_item_11.Item, PointB=list_item_11.Item1, PointC=list_item_11.Item2)
merge_6 = Merge(Data1=meshes_3, Data2=planes_3, Data3=skeleton_7)  # -> flatten(Result)
plane_3pt_7 = Plane3Pt(PointA=list_item_12.Item, PointB=list_item_12.Item1, PointC=list_item_12.Item2)
plane_3pt_8 = Plane3Pt(PointA=list_item_13.Item, PointB=list_item_13.Item1, PointC=list_item_13.Item2)
merge_7 = Merge(Data1=meshes_4, Data2=planes_4, Data3=skeleton_8)  # -> flatten(Result)
plane_3pt_9 = Plane3Pt(PointA=list_item_14.Item, PointB=list_item_14.Item1, PointC=list_item_14.Item2)
plane_3pt_10 = Plane3Pt(PointA=list_item_15.Item, PointB=list_item_15.Item1, PointC=list_item_15.Item2)
merge_8 = Merge(Data1=meshes_5, Data2=planes_5, Data3=skeleton_9)  # -> flatten(Result)
orient = Orient(Geometry=merge_5, Source=plane_3pt, Target=plane_3pt_2)  # -> Geometry, Transform
orient_2 = Orient(Geometry=merge_6, Source=plane_3pt_5, Target=plane_3pt_6)  # -> Geometry, Transform
orient_3 = Orient(Geometry=merge_7, Source=plane_3pt_7, Target=plane_3pt_8)  # -> Geometry, Transform
orient_4 = Orient(Geometry=merge_8, Source=plane_3pt_9, Target=plane_3pt_10)  # -> Geometry, Transform
list_item_16 = ListItem(List=orient.Geometry, Index=0, Wrap=True)  # -> Item, Item1, Item2
list_item_17 = ListItem(List=orient_2.Geometry, Index=0, Wrap=True)  # -> Item, Item1, Item2
list_item_18 = ListItem(List=orient_3.Geometry, Index=0, Wrap=True)  # -> Item, Item1, Item2
list_item_19 = ListItem(List=orient_4.Geometry, Index=0, Wrap=True)  # -> Item, Item1, Item2
ungroup = Ungroup(Group=list_item_16.Item)
ungroup_2 = Ungroup(Group=list_item_16.Item1)
ungroup_3 = Ungroup(Group=list_item_16.Item2)
ungroup_4 = Ungroup(Group=list_item_17.Item)
ungroup_5 = Ungroup(Group=list_item_17.Item1)
ungroup_6 = Ungroup(Group=list_item_17.Item2)
ungroup_7 = Ungroup(Group=list_item_18.Item)
ungroup_8 = Ungroup(Group=list_item_18.Item1)
ungroup_9 = Ungroup(Group=list_item_18.Item2)
ungroup_10 = Ungroup(Group=list_item_19.Item)
ungroup_11 = Ungroup(Group=list_item_19.Item1)
ungroup_12 = Ungroup(Group=list_item_19.Item2)
list_item_20 = ListItem(List=ungroup, Index=0, Wrap=True)
list_item_21 = ListItem(List=ungroup_4, Index=0, Wrap=True)
list_item_22 = ListItem(List=ungroup_7, Index=0, Wrap=True)
list_item_23 = ListItem(List=ungroup_10, Index=0, Wrap=True)

# ---- group: Rhino Object Preview
mesh_6 = Mesh(list_item_20)
plane_11 = Plane(ungroup_2)
curve_15 = Curve(ungroup_3)
enumerator_6 = Enumerator(Object=plane_11)  # -> Numbers, Color
custom_preview_lineweights_6 = CustomPreviewLineweights(Geometry=curve_15, Shader=random_color, Thickness=10, Absolute=False)

mesh_7 = Mesh(list_item_21)
plane_12 = Plane(ungroup_5)
curve_16 = Curve(ungroup_6)
enumerator_7 = Enumerator(Object=plane_12)  # -> Numbers, Color
custom_preview_lineweights_7 = CustomPreviewLineweights(
    Geometry=curve_16,
    Shader={diffuse=RGB(255, 105, 180), emission=RGB(76, 32, 54), shine=0.5, specular=RGB(255, 255, 255), transparency=0},
    Thickness=10,
    Absolute=False)

mesh_8 = Mesh(list_item_22)
plane_13 = Plane(ungroup_8)
curve_17 = Curve(ungroup_9)
enumerator_8 = Enumerator(Object=plane_13)  # -> Numbers, Color
custom_preview_lineweights_8 = CustomPreviewLineweights(
    Geometry=curve_17,
    Shader={diffuse=RGB(255, 105, 180), emission=RGB(76, 32, 54), shine=0.5, specular=RGB(255, 255, 255), transparency=0},
    Thickness=10,
    Absolute=False)

mesh_9 = Mesh(list_item_23)
plane_14 = Plane(ungroup_11)
curve_18 = Curve(ungroup_12)
enumerator_9 = Enumerator(Object=plane_14)  # -> Numbers, Color
custom_preview_lineweights_9 = CustomPreviewLineweights(
    Geometry=curve_18,
    Shader={diffuse=RGB(255, 105, 180), emission=RGB(76, 32, 54), shine=0.5, specular=RGB(255, 255, 255), transparency=0},
    Thickness=10,
    Absolute=False)

# ----
createattributes_5 = CreateAttributes(LayerName="ExportFork2", enableFullPath=False)
concatenate_16 = Concatenate(FragmentA="Skeleton(Auto)_", FragmentB=graft("06"))  # -> flatten(Result)
concatenate_17 = Concatenate(FragmentA="Skeleton(Auto)_", FragmentB=graft("07"))  # -> flatten(Result)
concatenate_18 = Concatenate(FragmentA="Skeleton(Auto)_", FragmentB=graft("08"))  # -> flatten(Result)
concatenate_19 = Concatenate(FragmentA="Skeleton(Auto)_", FragmentB=graft("09"))  # -> flatten(Result)
concatenate_20 = Concatenate(FragmentA="Skeleton(Auto)_", FragmentB=graft("10"))  # -> flatten(Result)
concatenate_21 = Concatenate(FragmentA="Points_", FragmentB=graft("06"))  # -> flatten(Result)
concatenate_22 = Concatenate(FragmentA="Points_", FragmentB=graft("07"))  # -> flatten(Result)
concatenate_23 = Concatenate(FragmentA="Points_", FragmentB=graft("08"))  # -> flatten(Result)
concatenate_24 = Concatenate(FragmentA="Points_", FragmentB=graft("09"))  # -> flatten(Result)
concatenate_25 = Concatenate(FragmentA=["HighPoly_", "LowPoly_"], FragmentB=graft("06"))  # -> flatten(Result)
concatenate_26 = Concatenate(FragmentA="Points_", FragmentB=graft("10"))  # -> flatten(Result)
concatenate_27 = Concatenate(FragmentA=["HighPoly_", "LowPoly_"], FragmentB=graft("07"))  # -> flatten(Result)
concatenate_28 = Concatenate(FragmentA=["HighPoly_", "LowPoly_"], FragmentB=graft("08"))  # -> flatten(Result)
concatenate_29 = Concatenate(FragmentA=["HighPoly_", "LowPoly_"], FragmentB=graft("09"))  # -> flatten(Result)
concatenate_30 = Concatenate(FragmentA=["HighPoly_", "LowPoly_"], FragmentB=graft("10"))  # -> flatten(Result)
panel_17 = Panel(concatenate_16)
panel_18 = Panel(concatenate_17)
panel_19 = Panel(concatenate_25)
panel_20 = Panel(concatenate_21)
panel_21 = Panel(concatenate_18)
panel_22 = Panel(concatenate_27)
panel_23 = Panel(concatenate_22)
panel_24 = Panel(concatenate_19)
panel_25 = Panel(concatenate_28)
panel_26 = Panel(concatenate_23)
panel_27 = Panel(concatenate_20)
panel_28 = Panel(concatenate_29)
panel_29 = Panel(concatenate_24)
panel_30 = Panel(concatenate_30)
panel_31 = Panel(concatenate_26)
mesh_10 = DynamicGeometryPipeline(
    LayerFilter=panel_19,
    TypeFilter=["Point", "Curve", "Mesh"],
    NameFilter="*",
    GroupByLayer=False,
    GroupByType=False,
    IncludeHidden=True,
    IncludeLocked=True,
    enableFullPath=False,
    listenToAttributes=True)  # -> flatten(GeometryOut)
points_6 = DynamicGeometryPipeline(
    LayerFilter=panel_20,
    TypeFilter=["Point", "Curve", "Mesh"],
    NameFilter="*",
    GroupByLayer=False,
    GroupByType=False,
    IncludeHidden=True,
    IncludeLocked=True,
    enableFullPath=False,
    listenToAttributes=True)  # -> flatten(GeometryOut)
mesh_11 = DynamicGeometryPipeline(
    LayerFilter=panel_22,
    TypeFilter=["Point", "Curve", "Mesh"],
    NameFilter="*",
    GroupByLayer=False,
    GroupByType=False,
    IncludeHidden=True,
    IncludeLocked=True,
    enableFullPath=False,
    listenToAttributes=True)  # -> flatten(GeometryOut)
points_7 = DynamicGeometryPipeline(
    LayerFilter=panel_23,
    TypeFilter=["Point", "Curve", "Mesh"],
    NameFilter="*",
    GroupByLayer=False,
    GroupByType=False,
    IncludeHidden=True,
    IncludeLocked=True,
    enableFullPath=False,
    listenToAttributes=True)  # -> flatten(GeometryOut)
dynamic_geometry_pipeline_6 = DynamicGeometryPipeline(
    LayerFilter=panel_17,
    TypeFilter=["Point", "Curve"],
    NameFilter=["0", "1", "2"],
    GroupByLayer=False,
    GroupByType=False,
    IncludeHidden=True,
    IncludeLocked=True,
    enableFullPath=False,
    listenToAttributes=True)  # -> flatten(GeometryOut)
mesh_12 = DynamicGeometryPipeline(
    LayerFilter=panel_25,
    TypeFilter=["Point", "Curve", "Mesh"],
    NameFilter="*",
    GroupByLayer=False,
    GroupByType=False,
    IncludeHidden=True,
    IncludeLocked=True,
    enableFullPath=False,
    listenToAttributes=True)  # -> flatten(GeometryOut)
points_8 = DynamicGeometryPipeline(
    LayerFilter=panel_26,
    TypeFilter=["Point", "Curve", "Mesh"],
    NameFilter="*",
    GroupByLayer=False,
    GroupByType=False,
    IncludeHidden=True,
    IncludeLocked=True,
    enableFullPath=False,
    listenToAttributes=True)  # -> flatten(GeometryOut)
dynamic_geometry_pipeline_7 = DynamicGeometryPipeline(
    LayerFilter=panel_18,
    TypeFilter=["Point", "Curve"],
    NameFilter=["0", "1", "2"],
    GroupByLayer=False,
    GroupByType=False,
    IncludeHidden=True,
    IncludeLocked=True,
    enableFullPath=False,
    listenToAttributes=True)  # -> flatten(GeometryOut)
mesh_13 = DynamicGeometryPipeline(
    LayerFilter=panel_28,
    TypeFilter=["Point", "Curve", "Mesh"],
    NameFilter="*",
    GroupByLayer=False,
    GroupByType=False,
    IncludeHidden=True,
    IncludeLocked=True,
    enableFullPath=False,
    listenToAttributes=True)  # -> flatten(GeometryOut)
points_9 = DynamicGeometryPipeline(
    LayerFilter=panel_29,
    TypeFilter=["Point", "Curve", "Mesh"],
    NameFilter="*",
    GroupByLayer=False,
    GroupByType=False,
    IncludeHidden=True,
    IncludeLocked=True,
    enableFullPath=False,
    listenToAttributes=True)  # -> flatten(GeometryOut)
dynamic_geometry_pipeline_8 = DynamicGeometryPipeline(
    LayerFilter=panel_21,
    TypeFilter=["Point", "Curve"],
    NameFilter=["0", "1", "2"],
    GroupByLayer=False,
    GroupByType=False,
    IncludeHidden=True,
    IncludeLocked=True,
    enableFullPath=False,
    listenToAttributes=True)  # -> flatten(GeometryOut)
mesh_14 = DynamicGeometryPipeline(
    LayerFilter=panel_30,
    TypeFilter=["Point", "Curve", "Mesh"],
    NameFilter="*",
    GroupByLayer=False,
    GroupByType=False,
    IncludeHidden=True,
    IncludeLocked=True,
    enableFullPath=False,
    listenToAttributes=True)  # -> flatten(GeometryOut)
points_10 = DynamicGeometryPipeline(
    LayerFilter=panel_31,
    TypeFilter=["Point", "Curve", "Mesh"],
    NameFilter="*",
    GroupByLayer=False,
    GroupByType=False,
    IncludeHidden=True,
    IncludeLocked=True,
    enableFullPath=False,
    listenToAttributes=True)  # -> flatten(GeometryOut)
dynamic_geometry_pipeline_9 = DynamicGeometryPipeline(
    LayerFilter=panel_24,
    TypeFilter=["Point", "Curve"],
    NameFilter=["0", "1", "2"],
    GroupByLayer=False,
    GroupByType=False,
    IncludeHidden=True,
    IncludeLocked=True,
    enableFullPath=False,
    listenToAttributes=True)  # -> flatten(GeometryOut)
dynamic_geometry_pipeline_10 = DynamicGeometryPipeline(
    LayerFilter=panel_27,
    TypeFilter=["Point", "Curve"],
    NameFilter=["0", "1", "2"],
    GroupByLayer=False,
    GroupByType=False,
    IncludeHidden=True,
    IncludeLocked=True,
    enableFullPath=False,
    listenToAttributes=True)  # -> flatten(GeometryOut)
list_item_24 = ListItem(List=mesh_10, Index=1, Wrap=True)
list_item_25 = ListItem(List=mesh_11, Index=1, Wrap=True)
list_item_26 = ListItem(List=mesh_12, Index=1, Wrap=True)
list_item_27 = ListItem(List=mesh_13, Index=1, Wrap=True)
list_item_28 = ListItem(List=mesh_14, Index=1, Wrap=True)
skeleton_10 = Skeleton(mesh=list_item_24, passing_switch=Button(), point=points_6)  # -> curve_2, plane_2
skeleton_11 = Skeleton(mesh=list_item_25, passing_switch=Button(), point=points_7)  # -> curve_2, plane_2
skeleton_12 = Skeleton(mesh=list_item_26, passing_switch=Button(), point=points_8)  # -> curve_2, plane_2
skeleton_13 = Skeleton(mesh=list_item_27, passing_switch=Button(), point=points_9)  # -> curve_2, plane_2
skeleton_14 = Skeleton(mesh=list_item_28, passing_switch=Button(), point=points_10)  # -> curve_2, plane_2
curve_19 = Curve([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])
plane_15 = Plane([Plane(origin=(476.5809328, 1895.685356, 0), x=(0.8991578549, -0.2255379087, -0.3750304037), y=(-0.3696302234, 0.06738103881, -0.9267325901)), Plane(origin=(310.4402152, 1102.149559, 0), x=(-0.056545164, 0.1391250913, -0.9886591189), y=(0.9908108165, -0.1140447489, -0.07271671787)), Plane(origin=(277.6935818, 1868.792054, 0), x=(0.9386675143, 0.1246531567, -0.3215041029), y=(-0.3227632078, -0.01051715905, -0.9464213126))])
curve_20 = Curve([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])
plane_16 = Plane([Plane(origin=(1070.560955, 1109.660236, 0), x=(1.578048459e-05, -0.006043009174, -0.9999817407), y=(0.9988591977, 0.04775174022, -0.0002728067033)), Plane(origin=(914.4847931, 1817.895289, 0), x=(0.8961271733, 0.4394642226, -0.06186506511), y=(0.003761898326, -0.1469163045, -0.9891417733)), Plane(origin=(1149.434224, 1845.142514, 0), x=(0.9738338963, -0.2205542197, 0.05480308938), y=(0.04125472207, -0.06557628123, -0.9969943828))])
curve_21 = Curve([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])
plane_17 = Plane([Plane(origin=(1782.570793, 1104.389033, 0), x=(-0.04517808191, -0.1006457113, -0.9938960618), y=(0.9976039317, -0.05672800689, -0.03960213049)), Plane(origin=(1831.084848, 1874.202987, 0), x=(0.976349672, 0.00380282981, -0.2161639575), y=(-0.2161974014, 0.01698547613, -0.9762019142)), Plane(origin=(1568.765697, 1855.505392, 0), x=(0.9293361686, 0.3692231643, 0.002922455627), y=(0.01852763701, -0.03872628597, -0.9990780757))])
curve_22 = Curve([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])
plane_18 = Plane([Plane(origin=(2378.245664, 1138.048267, 0), x=(-0.009357597613, -0.01282961966, -0.9998739102), y=(0.9925454341, -0.1216299053, -0.007728349827)), Plane(origin=(2602.151309, 1804.375414, 0), x=(0.887652437, -0.4279586576, -0.1700721569), y=(0.004753050752, 0.3778036984, -0.9258735194)), Plane(origin=(2335.560482, 1812.728851, 0), x=(0.9998682148, 0.01623395131, 0.0001085551878), y=(8.989895092e-06, 0.006133099322, -0.9999811923))])
curve_23 = Curve([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])
plane_19 = Plane([Plane(origin=(3194.072742, 1150.72052, 0), x=(-7.21167795e-05, -0.07451610406, -0.9972198078), y=(0.9996269651, 0.02723033374, -0.002107046253)), Plane(origin=(3019.045659, 1812.759469, 0), x=(0.9814159512, 0.1918897415, -0.001028518504), y=(-0.02503197624, 0.1227077565, -0.9921271121)), Plane(origin=(3277.687366, 1825.301198, 0), x=(0.9638974108, -0.2388907883, 0.1176136587), y=(0.1043526049, -0.06746547663, -0.992249436))])

# ---- group: Calibratiom Planes
show_uvw_surface_6 = ShowUVWSurface(Surfaces=plane_15, Density=5)
plane_20 = Plane(plane_15)
enumerator_10 = Enumerator(Object=plane_20)  # -> Numbers, Color

show_uvw_surface_7 = ShowUVWSurface(Surfaces=plane_16, Density=5)
plane_21 = Plane(plane_16)
enumerator_11 = Enumerator(Object=plane_21)  # -> Numbers, Color

# ---- group: Skeleton
random_color_5 = GhPythonScript(Run=Button())  # -> Color; same code as random_color
curve_24 = Curve(curve_19)
custom_preview_lineweights_10 = CustomPreviewLineweights(Geometry=curve_24, Shader=random_color_5, Thickness=10, Absolute=False)

# ---- group: Calibratiom Planes
show_uvw_surface_8 = ShowUVWSurface(Surfaces=plane_17, Density=5)
plane_22 = Plane(plane_17)
enumerator_12 = Enumerator(Object=plane_22)  # -> Numbers, Color

# ---- group: Skeleton
random_color_6 = GhPythonScript(Run=Button())  # -> Color; same code as random_color
curve_25 = Curve(curve_20)
custom_preview_lineweights_11 = CustomPreviewLineweights(Geometry=curve_25, Shader=random_color_6, Thickness=10, Absolute=False)

# ---- group: Calibratiom Planes
show_uvw_surface_9 = ShowUVWSurface(Surfaces=plane_18, Density=5)
plane_23 = Plane(plane_18)
enumerator_13 = Enumerator(Object=plane_23)  # -> Numbers, Color

# ---- group: Skeleton
random_color_7 = GhPythonScript(Run=Button())  # -> Color; same code as random_color
curve_26 = Curve(curve_21)
custom_preview_lineweights_12 = CustomPreviewLineweights(Geometry=curve_26, Shader=random_color_7, Thickness=10, Absolute=False)

# ---- group: Calibratiom Planes
show_uvw_surface_10 = ShowUVWSurface(Surfaces=plane_19, Density=5)
plane_24 = Plane(plane_19)
enumerator_14 = Enumerator(Object=plane_24)  # -> Numbers, Color

# ---- group: Skeleton
random_color_8 = GhPythonScript(Run=Button())  # -> Color; same code as random_color
curve_27 = Curve(curve_23)
custom_preview_lineweights_13 = CustomPreviewLineweights(Geometry=curve_27, Shader=random_color_8, Thickness=10, Absolute=False)

# ----
point_6 = Point(plane_20)
curve_28 = Curve(curve_24)
point_7 = Point(plane_21)
curve_29 = Curve(curve_25)
point_8 = Point(plane_22)
curve_30 = Curve(curve_26)
point_9 = Point(plane_23)
point_10 = Point(plane_24)
curve_31 = Curve(curve_27)
merge_9 = Merge(Data1=point_6, Data2=curve_28)

# ---- group: Bake to Move Around
createattributes_6 = CreateAttributes(Name=["0", "1", "2", "3", "4", "5"], LayerName=panel_17, GroupIndices=0, enableFullPath=False)
bake_geometry_5 = BakeGeometry(Bake=Button(), Geometry=merge_9, Attributes=createattributes_6, DeleteOldBakes=False, PreserveTrees=False)

# ----
merge_10 = Merge(Data1=point_7, Data2=curve_29)

# ---- group: Bake to Move Around
createattributes_7 = CreateAttributes(Name=["0", "1", "2", "3", "4", "5"], LayerName=panel_18, GroupIndices=0, enableFullPath=False)
bake_geometry_6 = BakeGeometry(Bake=Button(), Geometry=merge_10, Attributes=createattributes_7, DeleteOldBakes=False, PreserveTrees=False)

# ----
merge_11 = Merge(Data1=point_8, Data2=curve_30)

# ---- group: Bake to Move Around
createattributes_8 = CreateAttributes(Name=["0", "1", "2", "3", "4", "5"], LayerName=panel_21, GroupIndices=0, enableFullPath=False)
bake_geometry_7 = BakeGeometry(Bake=Button(), Geometry=merge_11, Attributes=createattributes_8, DeleteOldBakes=False, PreserveTrees=False)

# ----
merge_12 = Merge(Data1=point_10, Data2=curve_31)

# ---- group: Bake to Move Around
createattributes_9 = CreateAttributes(Name=["0", "1", "2", "3", "4", "5"], LayerName=panel_27, GroupIndices=0, enableFullPath=False)
bake_geometry_8 = BakeGeometry(Bake=Button(), Geometry=merge_12, Attributes=createattributes_9, DeleteOldBakes=False, PreserveTrees=False)

# ----
meshes_6 = Group(Objects=mesh_10)
planes_6 = Group(Objects=plane_20)
skeleton_15 = Group(Objects=curve_24)
meshes_7 = Group(Objects=mesh_11)
planes_7 = Group(Objects=plane_21)
skeleton_16 = Group(Objects=curve_25)
list_item_29 = ListItem(List=plane_20, Index=0, Wrap=True)  # -> Item, Item1, Item2
list_item_30 = ListItem(List=dynamic_geometry_pipeline_6, Index=0, Wrap=True)  # -> Item, Item1, Item2
meshes_8 = Group(Objects=mesh_12)
planes_8 = Group(Objects=plane_22)
skeleton_17 = Group(Objects=curve_26)
list_item_31 = ListItem(List=plane_21, Index=0, Wrap=True)  # -> Item, Item1, Item2
list_item_32 = ListItem(List=dynamic_geometry_pipeline_7, Index=0, Wrap=True)  # -> Item, Item1, Item2
meshes_9 = Group(Objects=mesh_13)
planes_9 = Group(Objects=plane_23)
list_item_33 = ListItem(List=plane_22, Index=0, Wrap=True)  # -> Item, Item1, Item2
list_item_34 = ListItem(List=dynamic_geometry_pipeline_8, Index=0, Wrap=True)  # -> Item, Item1, Item2
meshes_10 = Group(Objects=mesh_14)
planes_10 = Group(Objects=plane_24)
skeleton_18 = Group(Objects=curve_27)
list_item_35 = ListItem(List=plane_23, Index=0, Wrap=True)  # -> Item, Item1, Item2
list_item_36 = ListItem(List=dynamic_geometry_pipeline_9, Index=0, Wrap=True)  # -> Item, Item1, Item2
list_item_37 = ListItem(List=plane_24, Index=0, Wrap=True)  # -> Item, Item1, Item2
list_item_38 = ListItem(List=dynamic_geometry_pipeline_10, Index=0, Wrap=True)  # -> Item, Item1, Item2
plane_3pt_11 = Plane3Pt(PointA=list_item_29.Item, PointB=list_item_29.Item1, PointC=list_item_29.Item2)
plane_3pt_12 = Plane3Pt(PointA=list_item_30.Item, PointB=list_item_30.Item1, PointC=list_item_30.Item2)
merge_13 = Merge(Data1=meshes_6, Data2=planes_6, Data3=skeleton_15)  # -> flatten(Result)
plane_3pt_13 = Plane3Pt(PointA=list_item_31.Item, PointB=list_item_31.Item1, PointC=list_item_31.Item2)
plane_3pt_14 = Plane3Pt(PointA=list_item_32.Item, PointB=list_item_32.Item1, PointC=list_item_32.Item2)
merge_14 = Merge(Data1=meshes_7, Data2=planes_7, Data3=skeleton_16)  # -> flatten(Result)
plane_3pt_15 = Plane3Pt(PointA=list_item_33.Item, PointB=list_item_33.Item1, PointC=list_item_33.Item2)
plane_3pt_16 = Plane3Pt(PointA=list_item_34.Item, PointB=list_item_34.Item1, PointC=list_item_34.Item2)
merge_15 = Merge(Data1=meshes_8, Data2=planes_8, Data3=skeleton_17)  # -> flatten(Result)
plane_3pt_17 = Plane3Pt(PointA=list_item_35.Item, PointB=list_item_35.Item1, PointC=list_item_35.Item2)
plane_3pt_18 = Plane3Pt(PointA=list_item_36.Item, PointB=list_item_36.Item1, PointC=list_item_36.Item2)
plane_3pt_19 = Plane3Pt(PointA=list_item_37.Item, PointB=list_item_37.Item1, PointC=list_item_37.Item2)
plane_3pt_20 = Plane3Pt(PointA=list_item_38.Item, PointB=list_item_38.Item1, PointC=list_item_38.Item2)
merge_16 = Merge(Data1=meshes_10, Data2=planes_10, Data3=skeleton_18)  # -> flatten(Result)
orient_5 = Orient(Geometry=merge_13, Source=plane_3pt_11, Target=plane_3pt_12)  # -> Geometry, Transform
orient_6 = Orient(Geometry=merge_14, Source=plane_3pt_13, Target=plane_3pt_14)  # -> Geometry, Transform
orient_7 = Orient(Geometry=merge_15, Source=plane_3pt_15, Target=plane_3pt_16)  # -> Geometry, Transform
orient_8 = Orient(Geometry=merge_16, Source=plane_3pt_19, Target=plane_3pt_20)  # -> Geometry, Transform
list_item_39 = ListItem(List=orient_5.Geometry, Index=0, Wrap=True)  # -> Item, Item1, Item2
list_item_40 = ListItem(List=orient_6.Geometry, Index=0, Wrap=True)  # -> Item, Item1, Item2
list_item_41 = ListItem(List=orient_7.Geometry, Index=0, Wrap=True)  # -> Item, Item1, Item2
list_item_42 = ListItem(List=orient_8.Geometry, Index=0, Wrap=True)  # -> Item, Item1, Item2
ungroup_13 = Ungroup(Group=list_item_39.Item)
ungroup_14 = Ungroup(Group=list_item_39.Item1)
ungroup_15 = Ungroup(Group=list_item_39.Item2)
ungroup_16 = Ungroup(Group=list_item_40.Item)
ungroup_17 = Ungroup(Group=list_item_40.Item1)
ungroup_18 = Ungroup(Group=list_item_40.Item2)
ungroup_19 = Ungroup(Group=list_item_41.Item)
ungroup_20 = Ungroup(Group=list_item_41.Item1)
ungroup_21 = Ungroup(Group=list_item_41.Item2)
ungroup_22 = Ungroup(Group=list_item_42.Item)
ungroup_23 = Ungroup(Group=list_item_42.Item1)
ungroup_24 = Ungroup(Group=list_item_42.Item2)
list_item_43 = ListItem(List=ungroup_13, Index=0, Wrap=True)
list_item_44 = ListItem(List=ungroup_16, Index=0, Wrap=True)
list_item_45 = ListItem(List=ungroup_19, Index=0, Wrap=True)
list_item_46 = ListItem(List=ungroup_22, Index=0, Wrap=True)

# ---- group: Rhino Object Preview
mesh_15 = Mesh(list_item_43)
plane_25 = Plane(ungroup_14)
curve_32 = Curve(ungroup_15)
enumerator_15 = Enumerator(Object=plane_25)  # -> Numbers, Color
custom_preview_lineweights_14 = CustomPreviewLineweights(
    Geometry=curve_32,
    Shader={diffuse=RGB(255, 105, 180), emission=RGB(76, 32, 54), shine=0.5, specular=RGB(255, 255, 255), transparency=0},
    Thickness=10,
    Absolute=False)

mesh_16 = Mesh(list_item_44)
plane_26 = Plane(ungroup_17)
curve_33 = Curve(ungroup_18)
enumerator_16 = Enumerator(Object=plane_26)  # -> Numbers, Color
custom_preview_lineweights_15 = CustomPreviewLineweights(
    Geometry=curve_33,
    Shader={diffuse=RGB(255, 105, 180), emission=RGB(76, 32, 54), shine=0.5, specular=RGB(255, 255, 255), transparency=0},
    Thickness=10,
    Absolute=False)

mesh_17 = Mesh(list_item_45)
plane_27 = Plane(ungroup_20)
curve_34 = Curve(ungroup_21)
enumerator_17 = Enumerator(Object=plane_27)  # -> Numbers, Color
custom_preview_lineweights_16 = CustomPreviewLineweights(
    Geometry=curve_34,
    Shader={diffuse=RGB(255, 105, 180), emission=RGB(76, 32, 54), shine=0.5, specular=RGB(255, 255, 255), transparency=0},
    Thickness=10,
    Absolute=False)

mesh_18 = Mesh(list_item_46)
plane_28 = Plane(ungroup_23)
curve_35 = Curve(ungroup_24)
enumerator_18 = Enumerator(Object=plane_28)  # -> Numbers, Color
custom_preview_lineweights_17 = CustomPreviewLineweights(
    Geometry=curve_35,
    Shader={diffuse=RGB(255, 105, 180), emission=RGB(76, 32, 54), shine=0.5, specular=RGB(255, 255, 255), transparency=0},
    Thickness=10,
    Absolute=False)

# ----
concatenate_31 = Concatenate(FragmentA="Skeleton(Auto)_", FragmentB=graft("12"))  # -> flatten(Result)
concatenate_32 = Concatenate(FragmentA="Skeleton(Auto)_", FragmentB=graft("13"))  # -> flatten(Result)
concatenate_33 = Concatenate(FragmentA="Skeleton(Auto)_", FragmentB=graft("11"))  # -> flatten(Result)
concatenate_34 = Concatenate(FragmentA="Skeleton(Auto)_", FragmentB=graft("14"))  # -> flatten(Result)
concatenate_35 = Concatenate(FragmentA="Skeleton(Auto)_", FragmentB=graft("15"))  # -> flatten(Result)
concatenate_36 = Concatenate(FragmentA="Points_", FragmentB=graft("12"))  # -> flatten(Result)
concatenate_37 = Concatenate(FragmentA="Points_", FragmentB=graft("13"))  # -> flatten(Result)
concatenate_38 = Concatenate(FragmentA="Points_", FragmentB=graft("11"))  # -> flatten(Result)
concatenate_39 = Concatenate(FragmentA="Points_", FragmentB=graft("14"))  # -> flatten(Result)
concatenate_40 = Concatenate(FragmentA="Points_", FragmentB=graft("15"))  # -> flatten(Result)
concatenate_41 = Concatenate(FragmentA=["HighPoly_", "LowPoly_"], FragmentB=graft("12"))  # -> flatten(Result)
concatenate_42 = Concatenate(FragmentA=["HighPoly_", "LowPoly_"], FragmentB=graft("13"))  # -> flatten(Result)
concatenate_43 = Concatenate(FragmentA=["HighPoly_", "LowPoly_"], FragmentB=graft("11"))  # -> flatten(Result)
concatenate_44 = Concatenate(FragmentA=["HighPoly_", "LowPoly_"], FragmentB=graft("14"))  # -> flatten(Result)
concatenate_45 = Concatenate(FragmentA=["HighPoly_", "LowPoly_"], FragmentB=graft("15"))  # -> flatten(Result)
panel_32 = Panel(concatenate_31)
panel_33 = Panel(concatenate_41)
panel_34 = Panel(concatenate_32)
panel_35 = Panel(concatenate_33)
panel_36 = Panel(concatenate_36)
panel_37 = Panel(concatenate_42)
panel_38 = Panel(concatenate_34)
panel_39 = Panel(concatenate_43)
panel_40 = Panel(concatenate_37)
panel_41 = Panel(concatenate_44)
panel_42 = Panel(concatenate_35)
panel_43 = Panel(concatenate_38)
panel_44 = Panel(concatenate_39)
panel_45 = Panel(concatenate_45)
panel_46 = Panel(concatenate_40)
mesh_19 = DynamicGeometryPipeline(
    LayerFilter=panel_33,
    TypeFilter=["Point", "Curve", "Mesh"],
    NameFilter="*",
    GroupByLayer=False,
    GroupByType=False,
    IncludeHidden=True,
    IncludeLocked=True,
    enableFullPath=False,
    listenToAttributes=True)  # -> flatten(GeometryOut)
points_11 = DynamicGeometryPipeline(
    LayerFilter=panel_36,
    TypeFilter=["Point", "Curve", "Mesh"],
    NameFilter="*",
    GroupByLayer=False,
    GroupByType=False,
    IncludeHidden=True,
    IncludeLocked=True,
    enableFullPath=False,
    listenToAttributes=True)  # -> flatten(GeometryOut)
mesh_20 = DynamicGeometryPipeline(
    LayerFilter=panel_37,
    TypeFilter=["Point", "Curve", "Mesh"],
    NameFilter="*",
    GroupByLayer=False,
    GroupByType=False,
    IncludeHidden=True,
    IncludeLocked=True,
    enableFullPath=False,
    listenToAttributes=True)  # -> flatten(GeometryOut)
points_12 = DynamicGeometryPipeline(
    LayerFilter=panel_40,
    TypeFilter=["Point", "Curve", "Mesh"],
    NameFilter="*",
    GroupByLayer=False,
    GroupByType=False,
    IncludeHidden=True,
    IncludeLocked=True,
    enableFullPath=False,
    listenToAttributes=True)  # -> flatten(GeometryOut)
mesh_21 = DynamicGeometryPipeline(
    LayerFilter=panel_39,
    TypeFilter=["Point", "Curve", "Mesh"],
    NameFilter="*",
    GroupByLayer=False,
    GroupByType=False,
    IncludeHidden=True,
    IncludeLocked=True,
    enableFullPath=False,
    listenToAttributes=True)  # -> flatten(GeometryOut)
points_13 = DynamicGeometryPipeline(
    LayerFilter=panel_43,
    TypeFilter=["Point", "Curve", "Mesh"],
    NameFilter="*",
    GroupByLayer=False,
    GroupByType=False,
    IncludeHidden=True,
    IncludeLocked=True,
    enableFullPath=False,
    listenToAttributes=True)  # -> flatten(GeometryOut)
dynamic_geometry_pipeline_11 = DynamicGeometryPipeline(
    LayerFilter=panel_32,
    TypeFilter=["Point", "Curve"],
    NameFilter=["0", "1", "2"],
    GroupByLayer=False,
    GroupByType=False,
    IncludeHidden=True,
    IncludeLocked=True,
    enableFullPath=False,
    listenToAttributes=True)  # -> flatten(GeometryOut)
mesh_22 = DynamicGeometryPipeline(
    LayerFilter=panel_41,
    TypeFilter=["Point", "Curve", "Mesh"],
    NameFilter="*",
    GroupByLayer=False,
    GroupByType=False,
    IncludeHidden=True,
    IncludeLocked=True,
    enableFullPath=False,
    listenToAttributes=True)  # -> flatten(GeometryOut)
points_14 = DynamicGeometryPipeline(
    LayerFilter=panel_44,
    TypeFilter=["Point", "Curve", "Mesh"],
    NameFilter="*",
    GroupByLayer=False,
    GroupByType=False,
    IncludeHidden=True,
    IncludeLocked=True,
    enableFullPath=False,
    listenToAttributes=True)  # -> flatten(GeometryOut)
dynamic_geometry_pipeline_12 = DynamicGeometryPipeline(
    LayerFilter=panel_34,
    TypeFilter=["Point", "Curve"],
    NameFilter=["0", "1", "2"],
    GroupByLayer=False,
    GroupByType=False,
    IncludeHidden=True,
    IncludeLocked=True,
    enableFullPath=False,
    listenToAttributes=True)  # -> flatten(GeometryOut)
mesh_23 = DynamicGeometryPipeline(
    LayerFilter=panel_45,
    TypeFilter=["Point", "Curve", "Mesh"],
    NameFilter="*",
    GroupByLayer=False,
    GroupByType=False,
    IncludeHidden=True,
    IncludeLocked=True,
    enableFullPath=False,
    listenToAttributes=True)  # -> flatten(GeometryOut)
points_15 = DynamicGeometryPipeline(
    LayerFilter=panel_46,
    TypeFilter=["Point", "Curve", "Mesh"],
    NameFilter="*",
    GroupByLayer=False,
    GroupByType=False,
    IncludeHidden=True,
    IncludeLocked=True,
    enableFullPath=False,
    listenToAttributes=True)  # -> flatten(GeometryOut)
dynamic_geometry_pipeline_13 = DynamicGeometryPipeline(
    LayerFilter=panel_35,
    TypeFilter=["Point", "Curve"],
    NameFilter=["0", "1", "2"],
    GroupByLayer=False,
    GroupByType=False,
    IncludeHidden=True,
    IncludeLocked=True,
    enableFullPath=False,
    listenToAttributes=True)  # -> flatten(GeometryOut)
dynamic_geometry_pipeline_14 = DynamicGeometryPipeline(
    LayerFilter=panel_38,
    TypeFilter=["Point", "Curve"],
    NameFilter=["0", "1", "2"],
    GroupByLayer=False,
    GroupByType=False,
    IncludeHidden=True,
    IncludeLocked=True,
    enableFullPath=False,
    listenToAttributes=True)  # -> flatten(GeometryOut)
dynamic_geometry_pipeline_15 = DynamicGeometryPipeline(
    LayerFilter=panel_42,
    TypeFilter=["Point", "Curve"],
    NameFilter=["0", "1", "2"],
    GroupByLayer=False,
    GroupByType=False,
    IncludeHidden=True,
    IncludeLocked=True,
    enableFullPath=False,
    listenToAttributes=True)  # -> flatten(GeometryOut)
list_item_47 = ListItem(List=mesh_19, Index=1, Wrap=True)
list_item_48 = ListItem(List=mesh_20, Index=1, Wrap=True)
list_item_49 = ListItem(List=mesh_21, Index=1, Wrap=True)
list_item_50 = ListItem(List=mesh_22, Index=1, Wrap=True)
list_item_51 = ListItem(List=mesh_23, Index=1, Wrap=True)

# ---- group: Preview Texture or Wireframe
texture = BooleanToggle(False)
texture_or_wireframe = TextureOrWireframe(
    tree=[list_item, list_item_2, list_item_3, list_item_4, list_item_5, list_item_49, list_item_47, list_item_48, list_item_50, list_item_51, list_item_24, list_item_25, list_item_26, list_item_27, list_item_28],
    gate=texture)  # -> s_0_2, closed, s_0
panel_47 = Panel(texture_or_wireframe.closed)
custom_preview_lineweights_18 = CustomPreviewLineweights(
    Geometry=texture_or_wireframe.s_0_2,
    Shader={diffuse=RGB(207, 207, 207), emission=RGB(62, 62, 62), shine=0.5, specular=RGB(255, 255, 255), transparency=0},
    Thickness=0.5,
    Absolute=False)
custom_preview = CustomPreview(
    Geometry=texture_or_wireframe.s_0,
    Material={diffuse=RGB(242, 242, 242), emission=RGB(73, 73, 73), shine=0.5, specular=RGB(255, 255, 255), transparency=0})

# ----
skeleton_19 = Skeleton(mesh=list_item_47, passing_switch=Button(), point=points_11)  # -> curve_2, plane_2
skeleton_20 = Skeleton(mesh=list_item_48, passing_switch=Button(), point=points_12)  # -> curve_2, plane_2
skeleton_21 = Skeleton(mesh=list_item_49, passing_switch=Button(), point=points_13)  # -> curve_2, plane_2
skeleton_22 = Skeleton(mesh=list_item_50, passing_switch=Button(), point=points_14)  # -> curve_2, plane_2
skeleton_23 = Skeleton(mesh=list_item_51, passing_switch=Button(), point=points_15)  # -> curve_2, plane_2
curve_36 = Curve([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])
plane_29 = Plane([Plane(origin=(1152.630259, 946.8905237, 0), x=(0.973928611, -0.2262522847, 0.01652163422), y=(0.001310276777, -0.0672176091, -0.9977374786)), Plane(origin=(970.2528746, 38.10825205, 0), x=(-0.004004140646, -0.0764932341, -0.9970620603), y=(0.9988503822, 0.04732351514, -0.007641917631)), Plane(origin=(962.5946351, 939.3717161, 0), x=(0.9933619176, 0.1139685414, -0.01559718824), y=(-0.01113848264, -0.03965486615, -0.9991513528))])
curve_37 = Curve([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])
plane_30 = Plane([Plane(origin=(1864.847315, 868.9380779, 0), x=(0.9875912082, -0.1570126421, -0.003261236256), y=(0.001166709947, 0.02810078593, -0.9996044141)), Plane(origin=(1614.237027, 864.0496927, 0), x=(0.9778115147, 0.2094519284, -0.003812016161), y=(-0.003925980179, 0.0001283438822, -0.9999922851)), Plane(origin=(1724.345842, 133.5600352, 0), x=(0.0001192172126, 0.0731144716, -0.9973235482), y=(0.9895804617, -0.1436041562, -0.0104094273))])
curve_38 = Curve([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])
plane_31 = Plane([Plane(origin=(2534.364648, 174.0793869, 0), x=(-0.05222361349, 0.02547040181, -0.9983105493), y=(0.994872322, -0.08537586691, -0.05422199063)), Plane(origin=(2513.83507, 751.9923324, 0), x=(0.9944718338, 0.104688383, -0.00813106119), y=(-0.0001337299657, -0.07617317455, -0.9970945941)), Plane(origin=(2245.132225, 742.7737941, 0), x=(0.5993721551, 0.7996147035, -0.03700467051), y=(-0.0517619652, -0.007415277034, -0.9986319205))])
curve_39 = Curve([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])
plane_32 = Plane([Plane(origin=(318.1396308, 54.68456417, 0), x=(5.36823935e-05, 0.01511712202, -0.9998857283), y=(0.988706449, 0.1498471947, 0.002318599406)), Plane(origin=(588.1874199, 824.4108012, 0), x=(0.8672321118, -0.4327799779, -0.2461908914), y=(-0.1510390256, 0.2424900979, -0.9583244572)), Plane(origin=(191.1345372, 937.3708465, 0), x=(0.9917912891, 0.1124429137, -0.06088209924), y=(-0.07961444996, 0.1704498856, -0.9821447835))])
curve_40 = Curve([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])
plane_33 = Plane([Plane(origin=(3049.352967, 165.4847961, 0), x=(0.0001476436148, -0.01719180404, -0.9998521991), y=(0.9939383606, 0.1099249566, -0.001743317325)), Plane(origin=(3356.256149, 638.2246942, 0), x=(0.6763767379, -0.7286534333, -0.1076042874), y=(-0.1913768151, -0.03278149618, -0.9809690556)), Plane(origin=(3045.401112, 781.4134656, 0), x=(0.9999637291, 0.008515774906, 0.0001487686281), y=(-2.355441808e-06, 0.01774360706, -0.9998425698))])

# ---- group: Calibratiom Planes
show_uvw_surface_11 = ShowUVWSurface(Surfaces=plane_29, Density=5)
plane_34 = Plane(plane_29)
enumerator_19 = Enumerator(Object=plane_34)  # -> Numbers, Color

show_uvw_surface_12 = ShowUVWSurface(Surfaces=plane_30, Density=5)
plane_35 = Plane(plane_30)
enumerator_20 = Enumerator(Object=plane_35)  # -> Numbers, Color

show_uvw_surface_13 = ShowUVWSurface(Surfaces=plane_32, Density=5)
plane_36 = Plane(plane_32)
enumerator_21 = Enumerator(Object=plane_36)  # -> Numbers, Color

# ---- group: Skeleton
random_color_9 = GhPythonScript(Run=Button())  # -> Color; same code as random_color
curve_41 = Curve(curve_36)
custom_preview_lineweights_19 = CustomPreviewLineweights(Geometry=curve_41, Shader=random_color_9, Thickness=10, Absolute=False)

# ---- group: Calibratiom Planes
show_uvw_surface_14 = ShowUVWSurface(Surfaces=plane_31, Density=5)
plane_37 = Plane(plane_31)
enumerator_22 = Enumerator(Object=plane_37)  # -> Numbers, Color

# ---- group: Skeleton
random_color_10 = GhPythonScript(Run=Button())  # -> Color; same code as random_color
curve_42 = Curve(curve_37)
custom_preview_lineweights_20 = CustomPreviewLineweights(Geometry=curve_42, Shader=random_color_10, Thickness=10, Absolute=False)

random_color_11 = GhPythonScript(Run=Button())  # -> Color; same code as random_color
curve_43 = Curve(curve_39)
custom_preview_lineweights_21 = CustomPreviewLineweights(Geometry=curve_43, Shader=random_color_11, Thickness=10, Absolute=False)

# ---- group: Calibratiom Planes
show_uvw_surface_15 = ShowUVWSurface(Surfaces=plane_33, Density=5)
plane_38 = Plane(plane_33)
enumerator_23 = Enumerator(Object=plane_38)  # -> Numbers, Color

# ---- group: Skeleton
random_color_12 = GhPythonScript(Run=Button())  # -> Color; same code as random_color
curve_44 = Curve(curve_38)
custom_preview_lineweights_22 = CustomPreviewLineweights(Geometry=curve_44, Shader=random_color_12, Thickness=10, Absolute=False)

random_color_13 = GhPythonScript(Run=Button())  # -> Color; same code as random_color
curve_45 = Curve(curve_40)
custom_preview_lineweights_23 = CustomPreviewLineweights(Geometry=curve_45, Shader=random_color_13, Thickness=10, Absolute=False)

# ----
point_11 = Point(plane_34)
curve_46 = Curve(curve_41)
point_12 = Point(plane_35)
curve_47 = Curve(curve_42)
point_13 = Point(plane_36)
curve_48 = Curve(curve_43)
point_14 = Point(plane_37)
curve_49 = Curve(curve_44)
point_15 = Point(plane_38)
curve_50 = Curve(curve_45)
merge_17 = Merge(Data1=point_11, Data2=curve_46)

# ---- group: Bake to Move Around
createattributes_10 = CreateAttributes(Name=["0", "1", "2", "3", "4", "5"], LayerName=panel_32, GroupIndices=0, enableFullPath=False)
bake_geometry_9 = BakeGeometry(Bake=Button(), Geometry=merge_17, Attributes=createattributes_10, DeleteOldBakes=False, PreserveTrees=False)

# ----
merge_18 = Merge(Data1=point_12, Data2=curve_47)

# ---- group: Bake to Move Around
createattributes_11 = CreateAttributes(Name=["0", "1", "2", "3", "4", "5"], LayerName=panel_34, GroupIndices=0, enableFullPath=False)
bake_geometry_10 = BakeGeometry(Bake=Button(), Geometry=merge_18, Attributes=createattributes_11, DeleteOldBakes=False, PreserveTrees=False)

# ----
merge_19 = Merge(Data1=point_13, Data2=curve_48)

# ---- group: Bake to Move Around
createattributes_12 = CreateAttributes(Name=["0", "1", "2", "3", "4", "5"], LayerName=panel_35, GroupIndices=0, enableFullPath=False)
bake_geometry_11 = BakeGeometry(Bake=Button(), Geometry=merge_19, Attributes=createattributes_12, DeleteOldBakes=False, PreserveTrees=False)

# ----
merge_20 = Merge(Data1=point_14, Data2=curve_49)

# ---- group: Bake to Move Around
createattributes_13 = CreateAttributes(Name=["0", "1", "2", "3", "4", "5"], LayerName=panel_38, GroupIndices=0, enableFullPath=False)
bake_geometry_12 = BakeGeometry(Bake=Button(), Geometry=merge_20, Attributes=createattributes_13, DeleteOldBakes=False, PreserveTrees=False)

# ----
merge_21 = Merge(Data1=point_15, Data2=curve_50)

# ---- group: Bake to Move Around
createattributes_14 = CreateAttributes(Name=["0", "1", "2", "3", "4", "5"], LayerName=panel_42, GroupIndices=0, enableFullPath=False)
bake_geometry_13 = BakeGeometry(Bake=Button(), Geometry=merge_21, Attributes=createattributes_14, DeleteOldBakes=False, PreserveTrees=False)

# ----
meshes_11 = Group(Objects=mesh_19)
planes_11 = Group(Objects=plane_34)
skeleton_24 = Group(Objects=curve_41)
meshes_12 = Group(Objects=mesh_20)
planes_12 = Group(Objects=plane_35)
skeleton_25 = Group(Objects=curve_42)
list_item_52 = ListItem(List=plane_34, Index=0, Wrap=True)  # -> Item, Item1, Item2
meshes_13 = Group(Objects=mesh_21)
planes_13 = Group(Objects=plane_36)
skeleton_26 = Group(Objects=curve_43)
list_item_53 = ListItem(List=dynamic_geometry_pipeline_11, Index=0, Wrap=True)  # -> Item, Item1, Item2
meshes_14 = Group(Objects=mesh_22)
planes_14 = Group(Objects=plane_37)
skeleton_27 = Group(Objects=curve_44)
list_item_54 = ListItem(List=plane_35, Index=0, Wrap=True)  # -> Item, Item1, Item2
list_item_55 = ListItem(List=plane_36, Index=0, Wrap=True)  # -> Item, Item1, Item2
list_item_56 = ListItem(List=dynamic_geometry_pipeline_12, Index=0, Wrap=True)  # -> Item, Item1, Item2
meshes_15 = Group(Objects=mesh_23)
planes_15 = Group(Objects=plane_38)
skeleton_28 = Group(Objects=curve_45)
list_item_57 = ListItem(List=dynamic_geometry_pipeline_13, Index=0, Wrap=True)  # -> Item, Item1, Item2
list_item_58 = ListItem(List=plane_37, Index=0, Wrap=True)  # -> Item, Item1, Item2
list_item_59 = ListItem(List=dynamic_geometry_pipeline_14, Index=0, Wrap=True)  # -> Item, Item1, Item2
list_item_60 = ListItem(List=plane_38, Index=0, Wrap=True)  # -> Item, Item1, Item2
list_item_61 = ListItem(List=dynamic_geometry_pipeline_15, Index=0, Wrap=True)  # -> Item, Item1, Item2
plane_3pt_21 = Plane3Pt(PointA=list_item_52.Item, PointB=list_item_52.Item1, PointC=list_item_52.Item2)
plane_3pt_22 = Plane3Pt(PointA=list_item_53.Item, PointB=list_item_53.Item1, PointC=list_item_53.Item2)
merge_22 = Merge(Data1=meshes_11, Data2=planes_11, Data3=skeleton_24)  # -> flatten(Result)
plane_3pt_23 = Plane3Pt(PointA=list_item_54.Item, PointB=list_item_54.Item1, PointC=list_item_54.Item2)
plane_3pt_24 = Plane3Pt(PointA=list_item_56.Item, PointB=list_item_56.Item1, PointC=list_item_56.Item2)
merge_23 = Merge(Data1=meshes_12, Data2=planes_12, Data3=skeleton_25)  # -> flatten(Result)
plane_3pt_25 = Plane3Pt(PointA=list_item_55.Item, PointB=list_item_55.Item1, PointC=list_item_55.Item2)
plane_3pt_26 = Plane3Pt(PointA=list_item_57.Item, PointB=list_item_57.Item1, PointC=list_item_57.Item2)
merge_24 = Merge(Data1=meshes_13, Data2=planes_13, Data3=skeleton_26)  # -> flatten(Result)
plane_3pt_27 = Plane3Pt(PointA=list_item_58.Item, PointB=list_item_58.Item1, PointC=list_item_58.Item2)
plane_3pt_28 = Plane3Pt(PointA=list_item_59.Item, PointB=list_item_59.Item1, PointC=list_item_59.Item2)
merge_25 = Merge(Data1=meshes_14, Data2=planes_14, Data3=skeleton_27)  # -> flatten(Result)
plane_3pt_29 = Plane3Pt(PointA=list_item_60.Item, PointB=list_item_60.Item1, PointC=list_item_60.Item2)
plane_3pt_30 = Plane3Pt(PointA=list_item_61.Item, PointB=list_item_61.Item1, PointC=list_item_61.Item2)
merge_26 = Merge(Data1=meshes_15, Data2=planes_15, Data3=skeleton_28)  # -> flatten(Result)
orient_9 = Orient(Geometry=merge_22, Source=plane_3pt_21, Target=plane_3pt_22)  # -> Geometry, Transform
orient_10 = Orient(Geometry=merge_23, Source=plane_3pt_23, Target=plane_3pt_24)  # -> Geometry, Transform
orient_11 = Orient(Geometry=merge_24, Source=plane_3pt_25, Target=plane_3pt_26)  # -> Geometry, Transform
orient_12 = Orient(Geometry=merge_25, Source=plane_3pt_27, Target=plane_3pt_28)  # -> Geometry, Transform
orient_13 = Orient(Geometry=merge_26, Source=plane_3pt_29, Target=plane_3pt_30)  # -> Geometry, Transform
list_item_62 = ListItem(List=orient_9.Geometry, Index=0, Wrap=True)  # -> Item, Item1, Item2
list_item_63 = ListItem(List=orient_10.Geometry, Index=0, Wrap=True)  # -> Item, Item1, Item2
list_item_64 = ListItem(List=orient_11.Geometry, Index=0, Wrap=True)  # -> Item, Item1, Item2
list_item_65 = ListItem(List=orient_12.Geometry, Index=0, Wrap=True)  # -> Item, Item1, Item2
list_item_66 = ListItem(List=orient_13.Geometry, Index=0, Wrap=True)  # -> Item, Item1, Item2
ungroup_25 = Ungroup(Group=list_item_62.Item)
ungroup_26 = Ungroup(Group=list_item_62.Item1)
ungroup_27 = Ungroup(Group=list_item_62.Item2)
ungroup_28 = Ungroup(Group=list_item_63.Item)
ungroup_29 = Ungroup(Group=list_item_63.Item1)
ungroup_30 = Ungroup(Group=list_item_63.Item2)
ungroup_31 = Ungroup(Group=list_item_64.Item)
ungroup_32 = Ungroup(Group=list_item_64.Item1)
ungroup_33 = Ungroup(Group=list_item_64.Item2)
ungroup_34 = Ungroup(Group=list_item_65.Item)
ungroup_35 = Ungroup(Group=list_item_65.Item1)
ungroup_36 = Ungroup(Group=list_item_65.Item2)
ungroup_37 = Ungroup(Group=list_item_66.Item)
ungroup_38 = Ungroup(Group=list_item_66.Item1)
ungroup_39 = Ungroup(Group=list_item_66.Item2)
list_item_67 = ListItem(List=ungroup_25, Index=0, Wrap=True)
list_item_68 = ListItem(List=ungroup_28, Index=0, Wrap=True)
list_item_69 = ListItem(List=ungroup_31, Index=0, Wrap=True)
list_item_70 = ListItem(List=ungroup_34, Index=0, Wrap=True)
list_item_71 = ListItem(List=ungroup_37, Index=0, Wrap=True)

# ---- group: Rhino Object Preview
mesh_24 = Mesh(list_item_67)
plane_39 = Plane(ungroup_26)
curve_51 = Curve(ungroup_27)
enumerator_24 = Enumerator(Object=plane_39)  # -> Numbers, Color
custom_preview_lineweights_24 = CustomPreviewLineweights(
    Geometry=curve_51,
    Shader={diffuse=RGB(255, 105, 180), emission=RGB(76, 32, 54), shine=0.5, specular=RGB(255, 255, 255), transparency=0},
    Thickness=10,
    Absolute=False)

mesh_25 = Mesh(list_item_68)
plane_40 = Plane(ungroup_29)
curve_52 = Curve(ungroup_30)
enumerator_25 = Enumerator(Object=plane_40)  # -> Numbers, Color
custom_preview_lineweights_25 = CustomPreviewLineweights(
    Geometry=curve_52,
    Shader={diffuse=RGB(255, 105, 180), emission=RGB(76, 32, 54), shine=0.5, specular=RGB(255, 255, 255), transparency=0},
    Thickness=10,
    Absolute=False)

mesh_26 = Mesh(list_item_69)
plane_41 = Plane(ungroup_32)
curve_53 = Curve(ungroup_33)
enumerator_26 = Enumerator(Object=plane_41)  # -> Numbers, Color
custom_preview_lineweights_26 = CustomPreviewLineweights(
    Geometry=curve_53,
    Shader={diffuse=RGB(255, 105, 180), emission=RGB(76, 32, 54), shine=0.5, specular=RGB(255, 255, 255), transparency=0},
    Thickness=10,
    Absolute=False)

mesh_27 = Mesh(list_item_70)
plane_42 = Plane(ungroup_35)
curve_54 = Curve(ungroup_36)
enumerator_27 = Enumerator(Object=plane_42)  # -> Numbers, Color
custom_preview_lineweights_27 = CustomPreviewLineweights(
    Geometry=curve_54,
    Shader={diffuse=RGB(255, 105, 180), emission=RGB(76, 32, 54), shine=0.5, specular=RGB(255, 255, 255), transparency=0},
    Thickness=10,
    Absolute=False)

mesh_28 = Mesh(list_item_71)
plane_43 = Plane(ungroup_38)
curve_55 = Curve(ungroup_39)
enumerator_28 = Enumerator(Object=plane_43)  # -> Numbers, Color
custom_preview_lineweights_28 = CustomPreviewLineweights(
    Geometry=curve_55,
    Shader={diffuse=RGB(255, 105, 180), emission=RGB(76, 32, 54), shine=0.5, specular=RGB(255, 255, 255), transparency=0},
    Thickness=10,
    Absolute=False)

# ---- group: Fabrication Preview
texture_2 = BooleanToggle(True)

# ---- group: Skeleton
random_color_14 = GhPythonScript(Run=Button())  # -> Color; same code as random_color
curve_56 = Curve(curve_3)

# ----
curve_57 = Curve(curve_56)
merge_27 = Merge(Data1=point_2, Data2=curve_57)

# ---- group: Bake to Move Around
createattributes_15 = CreateAttributes(Name=["0", "1", "2", "3", "4", "5"], LayerName=panel_3, GroupIndices=0, enableFullPath=False)
bake_geometry_14 = BakeGeometry(Bake=Button(), Geometry=merge_27, Attributes=createattributes_15, DeleteOldBakes=False, PreserveTrees=False)

# ----
skeleton_29 = Group(Objects=curve_56)
merge_28 = Merge(Data1=meshes_2, Data2=planes_2, Data3=skeleton_29)  # -> flatten(Result)
orient_14 = Orient(Geometry=merge_28, Source=plane_3pt_3, Target=plane_3pt_4)  # -> Geometry, Transform
list_item_72 = ListItem(List=orient_14.Geometry, Index=0, Wrap=True)  # -> Item, Item1, Item2
ungroup_40 = Ungroup(Group=list_item_72.Item)
ungroup_41 = Ungroup(Group=list_item_72.Item1)
ungroup_42 = Ungroup(Group=list_item_72.Item2)
list_item_73 = ListItem(List=ungroup_40, Index=0, Wrap=True)

# ---- group: Rhino Object Preview
mesh_29 = Mesh(list_item_73)
plane_44 = Plane(ungroup_41)
curve_58 = Curve(ungroup_42)
enumerator_29 = Enumerator(Object=plane_44)  # -> Numbers, Color

# ---- group: Skeleton (continued)
custom_preview_lineweights_29 = CustomPreviewLineweights(Geometry=[curve_56, curve_58], Shader=random_color_14, Thickness=10, Absolute=False)

# ----
bake_geometry_15 = BakeGeometry(
    Bake=Button(),
    Geometry=[mesh_29, plane_44, curve_58],
    Attributes=createattributes_5,
    DeleteOldBakes=False,
    PreserveTrees=False)

# ---- group: Skeleton
random_color_15 = GhPythonScript(Run=Button())  # -> Color; same code as random_color
curve_59 = Curve(curve_22)

# ----
curve_60 = Curve(curve_59)
merge_29 = Merge(Data1=point_9, Data2=curve_60)

# ---- group: Bake to Move Around
createattributes_16 = CreateAttributes(Name=["0", "1", "2", "3", "4", "5"], LayerName=panel_24, GroupIndices=0, enableFullPath=False)
bake_geometry_16 = BakeGeometry(Bake=Button(), Geometry=merge_29, Attributes=createattributes_16, DeleteOldBakes=False, PreserveTrees=False)

# ----
skeleton_30 = Group(Objects=curve_59)
merge_30 = Merge(Data1=meshes_9, Data2=planes_9, Data3=skeleton_30)  # -> flatten(Result)
orient_15 = Orient(Geometry=merge_30, Source=plane_3pt_17, Target=plane_3pt_18)  # -> Geometry, Transform
list_item_74 = ListItem(List=orient_15.Geometry, Index=0, Wrap=True)  # -> Item, Item1, Item2
ungroup_43 = Ungroup(Group=list_item_74.Item)
ungroup_44 = Ungroup(Group=list_item_74.Item1)
ungroup_45 = Ungroup(Group=list_item_74.Item2)
list_item_75 = ListItem(List=ungroup_43, Index=0, Wrap=True)

# ---- group: Rhino Object Preview
mesh_30 = Mesh(list_item_75)
plane_45 = Plane(ungroup_44)
curve_61 = Curve(ungroup_45)
enumerator_30 = Enumerator(Object=plane_45)  # -> Numbers, Color

# ---- group: Fabrication Preview (continued)
texture_or_wireframe_2 = TextureOrWireframe_2(tree=[mesh_6, mesh_29, mesh_7, mesh_30], gate=texture_2)  # -> s_1_2, closed, s_1
panel_48 = Panel(texture_or_wireframe_2.closed)
custom_preview_lineweights_30 = CustomPreviewLineweights(
    Geometry=texture_or_wireframe_2.s_1_2,
    Shader={diffuse=RGB(207, 207, 207), emission=RGB(62, 62, 62), shine=0.5, specular=RGB(255, 255, 255), transparency=0},
    Thickness=0.5,
    Absolute=False)  # disabled
custom_preview_2 = CustomPreview(
    Geometry=texture_or_wireframe_2.s_1,
    Material={diffuse=RGB(242, 242, 242), emission=RGB(73, 73, 73), shine=0.5, specular=RGB(255, 255, 255), transparency=0.7490196078})

# ---- group: Skeleton (continued)
custom_preview_lineweights_31 = CustomPreviewLineweights(Geometry=[curve_59, curve_61], Shader=random_color_15, Thickness=10, Absolute=False)

# ==== cluster TextureOrWireframe
tree = ClusterInput()
flatten_tree = FlattenTree(Tree=tree, Path="{0}")  # -> graft(Tree)
deconstruct_mesh = DeconstructMesh(Mesh=flatten_tree)  # -> Vertices, Faces, Colours, Normals
gate = ClusterInput()
stream_filter = StreamFilter(Gate=gate, Stream1=deconstruct_mesh.Colours)
construct_mesh = ConstructMesh(Vertices=deconstruct_mesh.Vertices, Faces=deconstruct_mesh.Faces, Colours=stream_filter)
stream_filter_2 = StreamFilter(Gate=gate, Stream1=construct_mesh)
s_0 = ClusterOutput(stream_filter_2)

# ---- group: Mesh Preview & Control
mesh_edges = MeshEdges(Mesh=construct_mesh)  # -> NakedEdges, InteriorEdges, NonManifoldEdges
is_mesh_closed = IsMeshClosed(Mesh=construct_mesh)

# ----
stream_filter_3 = StreamFilter(Gate=gate, Stream0=mesh_edges.InteriorEdges)
s_0_2 = ClusterOutput(stream_filter_3)
closed = ClusterOutput(is_mesh_closed)

# ==== cluster Skeleton
mesh = ClusterInput()
mesh_2 = Mesh(mesh)
point = ClusterInput()
passing_switch = ClusterInput()
point_2 = Point(point)
stream_freeze_gate = StreamFreezeGate(Data=mesh_2, PassingSwitch=passing_switch)
meshskeleton = MeshSkeleton(Mesh=stream_freeze_gate)
end_points = EndPoints(Curve=meshskeleton)  # -> Start, End
multiple_curves = MultipleCurves(Curves=meshskeleton)  # -> Points, IndexA, IndexB, ParamA, ParamB
removeduplicatepts = RemoveDuplicatePts(Points=multiple_curves.Points, Tolerance=0.01)
closest_point = ClosestPoint(Point=end_points.Start, Cloud=removeduplicatepts)  # -> ClosestPoint, CPIndex, Distance
equality = Equality(FirstNumber=closest_point.Distance, SecondNumber=0)  # -> Equality, Inequality
sift_pattern = SiftPattern(List=flatten(meshskeleton), SiftPattern=equality.Inequality)  # -> Output0, Output1
flip_curve = FlipCurve(Curve=sift_pattern.Output1)  # -> Curve, Flag
combine_data = CombineData(Input0=sift_pattern.Output0, Input1=flip_curve.Curve)  # -> Result, Index
end_points_2 = EndPoints(Curve=combine_data.Result)  # -> Start, End
length = Length(Curve=combine_data.Result)
line = Line(StartPoint=end_points_2.Start, EndPoint=end_points_2.End)
multiplication = Multiplication(A=length, B="0.2")
average = Average(Input=multiplication)
merge = Merge(Data1=end_points_2.End, Data2=point_2)  # -> flatten(Result)
vector_display = VectorDisplay(Anchor=end_points_2.Start, Vector=line)
point_groups = PointGroups(Points=merge, Distance=average)  # -> Groups, Indices
list_item = ListItem(List=point_groups.Groups, Index=0, Wrap=True)  # -> Item, Item1
line_2 = Line(StartPoint=list_item.Item, EndPoint=list_item.Item1)  # -> flatten(Line)
merge_2 = Merge(Data1=combine_data.Result, Data2=line_2)  # -> flatten(Result)
end_points_3 = EndPoints(Curve=merge_2)  # -> Start, End
point_groups_2 = PointGroups(Points=end_points_3.End, Distance=average)  # -> Groups, Indices
list_item_2 = ListItem(List=merge_2, Index=point_groups_2.Indices, Wrap=True)
join_curves = JoinCurves(Curves=list_item_2, Preserve=False)
curve = Curve(reparameterize(flatten(join_curves)))
perp_frame = PerpFrame(Curve=reparameterize(join_curves), Parameter=1)  # -> flatten(Frame)
curve_2 = ClusterOutput(curve)
deconstruct_plane = DeconstructPlane(Plane=perp_frame)  # -> Origin, XAxis, YAxis, ZAxis
line_sdl = LineSDL(Start=deconstruct_plane.Origin, Direction=deconstruct_plane.YAxis, Length=50)
line_sdl_2 = LineSDL(Start=deconstruct_plane.Origin, Direction=deconstruct_plane.ZAxis, Length=50)
project = Project(Geometry=line_sdl, Plane=Plane(origin=(0, 0, 0), x=(0, 0, 1), y=(1, 0, 0)))  # -> Geometry, Transform
project_2 = Project(Geometry=line_sdl_2, Plane=PlaneXY(0, 0, 0))  # -> Geometry, Transform
angle = Angle(VectorA=Vector(0, 0, 1), VectorB=project.Geometry)  # -> Angle, Reflex
angle_2 = Angle(VectorA=Vector(0, 1, 0), VectorB=project_2.Geometry)  # -> Angle, Reflex
degrees = Degrees(Radians=angle.Angle)
degrees_2 = Degrees(Radians=angle_2.Angle)
expression = Expression(x=degrees_2, Expression="If(x>90, +90, 0)")
addition = Addition(A=degrees, B=expression)
rotate_plane = RotatePlane(Plane=perp_frame, Angle=expr("x-180", degrees(addition)))
plane = Plane(rotate_plane)
plane_2 = ClusterOutput(plane)

# ==== cluster TextureOrWireframe_2
tree = ClusterInput()
flatten_tree = FlattenTree(Tree=tree, Path="{0}")  # -> graft(Tree)
deconstruct_mesh = DeconstructMesh(Mesh=flatten_tree)  # -> Vertices, Faces, Colours, Normals
gate = ClusterInput()
stream_filter = StreamFilter(Gate=gate, Stream1=deconstruct_mesh.Colours)
construct_mesh = ConstructMesh(Vertices=deconstruct_mesh.Vertices, Faces=deconstruct_mesh.Faces, Colours=stream_filter)
stream_filter_2 = StreamFilter(Gate=gate, Stream1=construct_mesh)
s_1 = ClusterOutput(stream_filter_2)

# ---- group: Mesh Preview & Control
mesh_edges = MeshEdges(Mesh=construct_mesh)  # -> NakedEdges, InteriorEdges, NonManifoldEdges
is_mesh_closed = IsMeshClosed(Mesh=construct_mesh)

# ----
stream_filter_3 = StreamFilter(Gate=gate, Stream0=mesh_edges.InteriorEdges)
s_1_2 = ClusterOutput(stream_filter_3)
closed = ClusterOutput(is_mesh_closed)
